# Grasshopper definition team_06_working.gh (Grasshopper 1.0.8)
# plug-ins: Swiftlet

# ----
# Connect MCP Tools to Decall and Update All Clusters
button = Button()
# IF SOMETHING IS NOT
# WORKING PRESS THIS
# BUTTON FIRST
toggle = BooleanToggle(True)
connect_mcp_tools_to_decall = CSharpScript(nickname_From="Central MCP Server", nickname_To="Central DeCall", connect=button)  # -> out; inputs nickname_From: String, nickname_To: String, connect: Boolean
# ---------- connect_mcp_tools_to_decall: C# ----------
using System;
using System.Linq;
using Grasshopper;
using Grasshopper.Kernel;

public class Script_Instance : GH_ScriptInstance
{
    private void RunScript(string nickname_From, string nickname_To, bool connect)
    {
        if (!connect) return;
        Console.Write($"Attempting to connect outputs from '{nickname_From}' to '{nickname_To}'...");

        var ghDoc = Instances.ActiveCanvas?.Document;
        if (ghDoc == null) return;

        var compFrom = ghDoc.Objects
            .OfType<IGH_Component>()
            .FirstOrDefault(o => o.NickName == nickname_From);

        var compTo = ghDoc.Objects
            .OfType<IGH_Param>()
            .FirstOrDefault(o => o.NickName == nickname_To);

        if (compFrom != null && compTo != null)
        {
            ghDoc.ScheduleSolution(5, doc => Connect(doc, compFrom, compTo));
        }
    }

    // <Custom additional code> 
    private void Connect(GH_Document doc, IGH_Component compFrom, IGH_Param compTo)
    {
        if (compFrom == null || compTo == null) return;

        foreach (IGH_Param param in compFrom.Params.Output)
        {
            compTo.AddSource(param);
        }
    }
}
# ---------- end connect_mcp_tools_to_decall ----------
update_all_clusters = CSharpScript(update=button, recursive=toggle)  # -> out, A; inputs update: Boolean, recursive: Boolean, passwords: list of String, localPath: String
# ---------- update_all_clusters: C# ----------
using System;
using System.Collections;
using System.Collections.Generic;

using Rhino;
using Rhino.Geometry;

using Grasshopper;
using Grasshopper.Kernel;
using Grasshopper.Kernel.Data;
using Grasshopper.Kernel.Types;
using System.Windows.Forms;
using System.Linq;
/// <summary>
/// This class will be instantiated on demand by the Script component.
/// </summary>
public class Script_Instance : GH_ScriptInstance
{
  /// <summary>Print a String to the [Out] Parameter of the Script component.</summary>
  /// <param name="text">String to print.</param>
  private void Print(string text) { /* Implementation hidden. */ }
  /// <summary>Print a formatted String to the [Out] Parameter of the Script component.</summary>
  /// <param name="format">String format.</param>
  /// <param name="args">Formatting parameters.</param>
  private void Print(string format, params object[] args) { /* Implementation hidden. */ }
  /// <summary>Print useful information about an object instance to the [Out] Parameter of the Script component. </summary>
  /// <param name="obj">Object instance to parse.</param>
  private void Reflect(object obj) { /* Implementation hidden. */ }
  /// <summary>Print the signatures of all the overloads of a specific method to the [Out] Parameter of the Script component. </summary>
  /// <param name="obj">Object instance to parse.</param>
  private void Reflect(object obj, string method_name) { /* Implementation hidden. */ }

  /// <summary>Gets the current Rhino document.</summary>
  private readonly RhinoDoc RhinoDocument;
  /// <summary>Gets the Grasshopper document that owns this script.</summary>
  private readonly GH_Document GrasshopperDocument;
  /// <summary>Gets the Grasshopper script component that owns this script.</summary>
  private readonly IGH_Component Component;
  /// <summary>
  /// Gets the current iteration count. The first call to RunScript() is associated with Iteration==0.
  /// Any subsequent call within the same solution will increment the Iteration count.
  /// </summary>
  private readonly int Iteration;

  /// <summary>
  /// This procedure contains the user code. Input parameters are provided as regular arguments,
  /// Output parameters as ref arguments. You don't have to assign output parameters,
  /// they will have a default value.
  /// </summary>
  private void RunScript(
		bool update,
		bool recursive,
		List<string> passwords,
		string localPath,
		ref object A)
  {

    A = updateLog;
    if (update)
    {
      updateLog = new List<string>();
      _passwords = passwords;
      UpdateClusters(GrasshopperDocument, recursive, localPath);
    }

  }

  // <Custom additional code> 
  List<string> updateLog;
  List<String> _passwords;

  void UpdateClusters (GH_Document ghDoc, bool recursive, string localPath)
  {
    foreach (var obj in ghDoc.Objects)
    {
      var cluster = obj as Grasshopper.Kernel.Special.GH_Cluster;
      if (cluster != null)
      {
        var clusterPath = cluster.FilePath;
        if (!string.IsNullOrEmpty(clusterPath))
        {
          if (cluster.Synchronisation == Grasshopper.Kernel.Special.GH_Synchronisation.OutOfDate)
          {
            cluster.CreateFromFilePath(clusterPath);
            updateLog.Add("Updated: " + clusterPath);
          }
          else if (cluster.Synchronisation == Grasshopper.Kernel.Special.GH_Synchronisation.MissingReference)
          {
            string newPath = ReplacePath(localPath, clusterPath);
            if (!string.IsNullOrEmpty(newPath))
            {
              cluster.CreateFromFilePath(newPath);
              updateLog.Add("Replaced and updated: " + newPath);
            }
            else
            {
              updateLog.Add("Missing reference: " + clusterPath);
            }

          }
        }

        //Update recursively
        if (recursive)
        {
          GH_Document clusterDoc = GetClusterDoc(cluster);
          if (clusterDoc != null)
            UpdateClusters(clusterDoc, recursive, localPath);
        }
      }
    }
  }

  GH_Document GetClusterDoc(Grasshopper.Kernel.Special.GH_Cluster cluster)
  {
    //no pass needed
    var doc = cluster.Document(string.Empty);
    if (doc != null)
      return doc;

    //try passwords
    if (_passwords != null && _passwords.Any())
    {
      foreach (var pass in _passwords)
      {
        doc = cluster.Document(pass);
        if (doc != null)
          return doc;
      }
    }

    return null;
  }

  string ReplacePath(string localPath, string missingPath)
  {
    if (String.IsNullOrEmpty(missingPath) || string.IsNullOrEmpty(localPath))
      return null;
    else
    {
      string lastLocalPart = localPath.Split('\\').Last();
      string[] parts = missingPath.Split('\\');
      if (parts.Contains(lastLocalPart))
      {
        int i = Array.IndexOf(parts, lastLocalPart);
        string clusterPath = String.Join("\\", parts.Skip(i + 1));
        string result = String.Join("\\", localPath, clusterPath);
        return result;
      }
      else
        return null;
    }
  }
  // </Custom additional code> 
}
# ---------- end update_all_clusters ----------
panel = Panel(connect_mcp_tools_to_decall)

team_06_definition_cluster = Team06DefinitionCluster()
c_script = CSharpScript()  # -> out, availablePort
# ---------- c_script: C# ----------
// Grasshopper Script Instance
// This script finds an available port on the local machine.
#region Usings
using System;
using System.Linq;
using System.Collections;
using System.Collections.Generic;
using System.Drawing;
using System.Net;
using System.Net.Sockets;

using Rhino;
using Rhino.Geometry;

using Grasshopper;
using Grasshopper.Kernel;
using Grasshopper.Kernel.Data;
using Grasshopper.Kernel.Types;
#endregion

public class Script_Instance : GH_ScriptInstance
{
    #region Notes
    /* 
      Members:
        RhinoDoc RhinoDocument
        GH_Document GrasshopperDocument
        IGH_Component Component
        int Iteration

      Methods (Virtual & overridable):
        Print(string text)
        Print(string format, params object[] args)
        Reflect(object obj)
        Reflect(object obj, string method_name)
    */
    #endregion

    private void RunScript(object start, object end, ref object availablePort)
    {
        // Use default values if parameters are not provided
        int startPort = (start != null && int.TryParse(start.ToString(), out int s)) ? s : 3001;
        int endPort = (end != null && int.TryParse(end.ToString(), out int e)) ? e : 3100;

        // Find an available port in the specified range
        try
        {
            availablePort = FindAvailablePortInRange(startPort, endPort);
            Print($"Available port found: {availablePort}");
        }
        catch (Exception ex)
        {
            Print($"Error: {ex.Message}");
            availablePort = null;
        }
    }

    /// <summary>
    /// Checks if a local TCP port is available for binding (i.e., not in use).
    /// Returns True if available, False otherwise.
    /// </summary>
    private bool IsPortAvailableForBind(int port)
    {
        try
        {
            // Create a new TCP socket
            using (Socket socket = new Socket(AddressFamily.InterNetwork, SocketType.Stream, ProtocolType.Tcp))
            {
                // Try to bind to the port on all interfaces (0.0.0.0)
                socket.Bind(new IPEndPoint(IPAddress.Any, port));
                // If successful, the socket is closed by the using statement and return True
                return true;
            }
        }
        catch (SocketException)
        {
            // If binding fails, it means the port is already in use
            return false;
        }
    }

    /// <summary>
    /// Finds an available port by letting the OS assign one.
    /// </summary>
    private int FindAvailablePort()
    {
        Socket socket = new Socket(AddressFamily.InterNetwork, SocketType.Stream, ProtocolType.Tcp);
        socket.Bind(new IPEndPoint(IPAddress.Any, 0)); // Bind to an available port assigned by the OS
        int availablePort = ((IPEndPoint)socket.LocalEndPoint).Port; // Get the assigned port number
        socket.Close(); // Close the socket
        return availablePort;
    }

    /// <summary>
    /// Finds the first available port in a given range.
    /// </summary>
    private int FindAvailablePortInRange(int start = 3001, int end = 3100)
    {
        for (int port = start; port <= end; port++)
        {
            if (IsPortAvailableForBind(port))
                return port;
        }
        throw new Exception($"No available ports found in the range {start}-{end}.");
    }
}
# ---------- end c_script ----------
central_mcp_server = MCPServer(Port=c_script.availablePort, Tools=team_06_definition_cluster, ServerName="Swiftlet")  # -> Delete_room_06, Add_window_06, Adapt_layout_06, Daylight_06
panel_2 = Panel(c_script.availablePort)
get_tool_names = CSharpScript(x=team_06_definition_cluster)  # -> flatten(out)
# ---------- get_tool_names: C# ----------
// Grasshopper Script Instance
#region Usings
using System;
using System.Linq;
using System.Collections;
using System.Collections.Generic;
using System.Drawing;

using Rhino;
using Rhino.Geometry;

using Grasshopper;
using Grasshopper.Kernel;
using Grasshopper.Kernel.Data;
using Grasshopper.Kernel.Types;
#endregion

public class Script_Instance : GH_ScriptInstance
{
    #region Notes
    /* 
      Members:
        RhinoDoc RhinoDocument
        GH_Document GrasshopperDocument
        IGH_Component Component
        int Iteration

      Methods (Virtual & overridable):
        Print(string text)
        Print(string format, params object[] args)
        Reflect(object obj)
        Reflect(object obj, string method_name)
    */
    #endregion

    private void RunScript(object x)
    {
        dynamic dynamicX = x;
        Console.Write(dynamicX.Name);
    }
}
# ---------- end get_tool_names ----------
central_decall = Data([central_mcp_server.Delete_room_06, central_mcp_server.Add_window_06, central_mcp_server.Adapt_layout_06, central_mcp_server.Daylight_06])
clean = CleanTree(RemoveNulls=True, RemoveInvalid=True, RemoveEmpty=False, Tree=central_decall)
team_06_result_cluster = Team06ResultCluster(tool_call_request=clean)  # -> tool_names_3, tool_call_success

# ----
# Tool Names from the Results Clusters
# Tool Names from the Definition Clusters
# These Two Clusters should be EXACTLY THE SAME
panel_3 = Panel(get_tool_names)
panel_4 = Panel(team_06_result_cluster.tool_names_3)

rec = DataRecorder(team_06_result_cluster.tool_call_success, DataLimit=-10, RecordData=True)
rec_2 = DataRecorder(clean, DataLimit=-10, RecordData=True)
response_ok = Panel(rec)
called_tool_name = Panel(rec_2)

# ---- group: Request Parameters
decall = DeconstructToolCall(Request=clean)  # -> Request, Tool, Arguments
rjo = ReadJSONObject(JObject=decall.Arguments)  # -> Keys, JTokens
# Debug: Check request input data
panel_5 = Panel("room_name")
tmatch = MatchText(Text=rjo.Keys, Pattern=panel_5, Case=True)
tmatch_2 = MatchText(Text=rjo.Keys, Pattern="layout_json", Case=True)
dispatch = Dispatch(List=rjo.JTokens, DispatchPattern=tmatch)  # -> ListA, ListB
dispatch_2 = Dispatch(List=rjo.JTokens, DispatchPattern=tmatch_2)  # -> ListA, ListB
panel_6 = Panel(dispatch.ListA)
panel_7 = Panel(dispatch_2.ListA)

# ----
# Debug Tool Names
# This Panel should always be TRUE
tool_names_from_the_results_clusters = Data(panel_4)
tool_names_from_the_definition_clusters = Data(panel_3)
join = TextJoin(Text=flatten(tool_names_from_the_definition_clusters))
join_2 = TextJoin(Text=flatten(tool_names_from_the_results_clusters))
tstat = TreeStatistics(Tree=tool_names_from_the_definition_clusters)  # -> Paths, Length, Count
tstat_2 = TreeStatistics(Tree=tool_names_from_the_results_clusters)  # -> Paths, Length, Count
dpath = DeconstructPath(Branch=tstat.Paths)
dpath_2 = DeconstructPath(Branch=tstat_2.Paths)
equals = Equality(FirstNumber=tstat.Length, SecondNumber=tstat_2.Length)  # -> Equality, Inequality
equals_2 = Equality(FirstNumber=tstat.Count, SecondNumber=tstat_2.Count)  # -> Equality, Inequality
ma = MassAddition(Input=flatten(equals.Equality))  # -> Result, PartialResults
equals_3 = Equality(FirstNumber=dpath, SecondNumber=dpath_2)  # -> Equality, Inequality
lng = ListLength(List=equals.Equality)
ma_2 = MassAddition(Input=flatten(equals_3.Inequality))  # -> Result, PartialResults
equals_4 = Equality(FirstNumber=ma.Result, SecondNumber=lng)  # -> Equality, Inequality
does_quantity_of_tools_match = Panel(equals_2.Equality)
equals_5 = Equality(FirstNumber=ma_2.Result, SecondNumber="0")  # -> Equality, Inequality
does_quantity_of_tools_match_per_team = Panel(equals_4.Equality)
are_all_teams_included = Panel(equals_5.Equality)

tmatch_3 = MatchText(Text=join, Pattern=join_2, Case=True)

do_all_names_match = Panel(tmatch_3)
and = GateAnd(A=equals_5.Equality, B=equals_4.Equality, C=equals_2.Equality, D=tmatch_3)  # -> flatten(Result)
do_trees_match = Panel(and)

# ==== cluster Team06DefinitionCluster
panel = Panel("This tool perform daylight analysis on the selected layout with a defined Window to Wall Ratio for the facades")
panel_2 = Panel("This tool add a window given a room name and the width of the window")
panel_3 = Panel("This tool deletes a room by giving it a room name and the layout json")
panel_4 = Panel("This tool add a window given a room name and the width of the window")
param = DefineToolParameter(
    Name="window_wall_ratio",
    Type="number",
    Description="the ratio betwenn the window and the wall hosting it",
    Required=Toggle(False))
param_2 = DefineToolParameter(Name="layout_json", Type="string", Description="the layout data structure", Required=Toggle(True))
param_3 = DefineToolParameter(Name="input_layout", Type="string", Description="the input layout giving the outline", Required=Toggle(True))
param_4 = DefineToolParameter(Name="layout_json", Type="string", Description="the reference layout to be adapted", Required=Toggle(True))
param_5 = DefineToolParameter(Name="room_name", Type="string", Description="the name of the room", Required=Toggle(True))
param_6 = DefineToolParameter(Name="room_name", Type="string", Description="the name of the room", Required=Toggle(True))
param_7 = DefineToolParameter(Name="layout_json", Type="string", Description="the layout data structure", Required=Toggle(True))
param_8 = DefineToolParameter(Name="layout_json", Type="string", Description="the layout data structure", Required=Toggle(True))
param_9 = DefineToolParameter(Name="width", Type="number", Description="The width of the window", Required=Toggle(True))
merge = Merge(Data1=param_2, Data2=param)
merge_2 = Merge(Data1=param_4, Data2=param_3)
merge_3 = Merge(Data1=param_5, Data2=param_7)
merge_4 = Merge(Data1=param_6, Data2=param_9, Data3=param_8)
tool = DefineTool(Name="daylight_06", Description=panel, Parameters=merge)
tool_2 = DefineTool(Name="adapt_layout_06", Description=panel_2, Parameters=merge_2)
tool_3 = DefineTool(Name="add_window_06", Description=panel_4, Parameters=merge_4)
tool_4 = DefineTool(Name="delete_room_06", Description=panel_3, Parameters=merge_3)
merge_5 = Merge(Data1=tool_4, Data2=tool_3, Data3=tool_2, Data4=tool)
mcp_tool_list = ClusterOutput(merge_5)
py3 = Python3Script()  # -> out, a; inputs crv: list of Polyline, u: list of String, ptCirc: list of Point3d, crvBounds: Polyline, crvFacade: list of Polyline, crvCirc: list of Polyline, id: String
# ---------- py3: Python ----------
import json
from typing import List, Tuple, Dict, Any
from pathlib import Path


def polyline_to_coords(polyline) -> List[Tuple[float, float]]:
    """Convert Rhino Polyline to list of [x, y] coordinates"""
    coords = []
    for i in range(polyline.Count):
        pt = polyline[i]
        coords.append([pt.X, pt.Y])
    return coords


def point3d_to_coords(point) -> Tuple[float, float]:
    """Convert Rhino Point3d to [x, y]"""
    return [point.X, point.Y]


def line_to_coords(line) -> List[List[float]]:
    """Convert Rhino Line to [[x1, y1], [x2, y2]]"""
    return [[line.From.X, line.From.Y], [line.To.X, line.To.Y]]


def calculate_polygon_area(coords: List[List[float]]) -> float:
    """Calculate polygon area using shoelace formula"""
    if len(coords) < 3:
        return 0.0
    area = 0.0
    for i in range(len(coords) - 1):
        area += coords[i][0] * coords[i + 1][1]
        area -= coords[i + 1][0] * coords[i][1]
    return abs(area) / 2.0


def calculate_polyline_length(coords: List[List[float]]) -> float:
    """Calculate total length of a polyline"""
    if len(coords) < 2:
        return 0.0
    length = 0.0
    for i in range(len(coords) - 1):
        dx = coords[i + 1][0] - coords[i][0]
        dy = coords[i + 1][1] - coords[i][1]
        length += (dx**2 + dy**2) ** 0.5
    return round(length, 2)


def find_adjacent_rooms(door_coords: List[List[float]], rooms_coords: Dict[str, List[List[float]]]) -> List[str]:
    """Find which rooms a door connects to (simple proximity check)"""
    door_pt = door_coords[0]  # Use first point
    adjacent = []
    
    for room_id, coords in rooms_coords.items():
        # Check if door is near room boundary
        for i in range(len(coords) - 1):
            p1 = coords[i]
            p2 = coords[i + 1]
            dist = point_to_line_distance(door_pt, p1, p2)
            if dist < 0.5:  # Threshold: door within 0.5 units of boundary
                if room_id not in adjacent:
                    adjacent.append(room_id)
                break
    
    return adjacent


def point_to_line_distance(pt: List[float], p1: List[float], p2: List[float]) -> float:
    """Calculate distance from point to line segment"""
    x, y = pt
    x1, y1 = p1
    x2, y2 = p2
    
    denom = (x2 - x1) ** 2 + (y2 - y1) ** 2
    if denom == 0:
        return ((x - x1) ** 2 + (y - y1) ** 2) ** 0.5
    
    t = max(0, min(1, ((x - x1) * (x2 - x1) + (y - y1) * (y2 - y1)) / denom))
    closest_x = x1 + t * (x2 - x1)
    closest_y = y1 + t * (y2 - y1)
    
    return ((x - closest_x) ** 2 + (y - closest_y) ** 2) ** 0.5

def schema_to_desc(schema):
    """
    Convert a layout schema dict (or JSON string) to a simple description string.
    
    Args:
        schema: dict or JSON string representation of layout schema
    
    Returns format:
        "Name (ID). 1 bed, 1 bath, 1 living. Area: 600 sqft."
    """
    try:
        # If schema is a string, parse it as JSON first
        if isinstance(schema, str):
            schema = json.loads(schema)
        
        apt = schema.get("apartment", {})
        name = apt.get("name", "?")
        apt_id = apt.get("id", "?")
        area = apt.get("attributes", {}).get("area", 0)
        
        # Count rooms by program
        rooms = schema.get("rooms", [])
        room_counts = {}
        for room in rooms:
            prog = room.get("program", "?")
            room_counts[prog] = room_counts.get(prog, 0) + 1
        
        # Format room counts: "1 bed, 2 bath, 1 living"
        room_str = ", ".join([f"{count} {prog}" for prog, count in sorted(room_counts.items())])
        
        # Simple format
        desc = f"{name} (ID: {apt_id}). {room_str}. Area: {area:.0f} m2."
        return desc
    
    except:
        return "Error parsing schema"
    
def geometry_to_layout_schema(
    crvBounds,
    crv: List,
    u: List[str],
    crvFacade: List = None,
    crvCirc: List = None,
    ptCirc: List = None,
    layout_id: str = "Layout-001",
    apartment_id: str = "apartment-1",
    apartment_name: str = "Sample Apartment"
) -> Dict[str, Any]:
    """
    Convert Grasshopper geometry to extended layout schema
    
    Args:
        crvBounds: Single polyline for building outline
        crv: List of polylines for room boundaries
        u: List of room program names (e.g., ["living", "bed", "kitchen"])
        crvFacade: List of polylines for facade elements
        crvCirc: List of polylines for circulation
        ptCirc: List of Point3d for door locations
        layout_id: ID for the layout
        apartment_id: ID for the apartment
        apartment_name: Name for the apartment
    
    Returns:
        Dictionary with extended layout_schema structure
    """
    
    # Convert bounds
    outline_coords = polyline_to_coords(crvBounds)
    outline_area = calculate_polygon_area(outline_coords)
    
    # Create apartment object
    apartment = {
        "id": apartment_id,
        "name": apartment_name,
        "geometry": outline_coords,
        "attributes": {
            "area": round(outline_area, 2)
        }
    }
    
    # Process rooms
    rooms = []
    rooms_coords = {}
    
    for i, room_polyline in enumerate(crv):
        room_coords = polyline_to_coords(room_polyline)
        room_id = f"room-{i + 1}"
        rooms_coords[room_id] = room_coords
        
        room_program = u[i] if i < len(u) else "unknown"
        room_area = calculate_polygon_area(room_coords)
        
        room = {
            "id": room_id,
            "name": f"{room_program.capitalize()}",
            "program": room_program,
            "geometry": room_coords,
            "attributes": {
                "area": round(room_area, 2)
            }
        }
        rooms.append(room)
    
    # Process doors
    doors = []
    if ptCirc:
        for i, door_pt in enumerate(ptCirc):
            door_coords = [point3d_to_coords(door_pt)]
            adjacent_rooms = find_adjacent_rooms(door_coords, rooms_coords)
            
            door = {
                "id": f"door-{i + 1}",
                "name": f"Door {i + 1}",
                "geometry": door_coords,
                "attributes": {
                    "connectsRooms": adjacent_rooms
                }
            }
            doors.append(door)
    
    # Process facades
    facades = []
    if crvFacade:
        for i, facade_polyline in enumerate(crvFacade):
            facade_coords = polyline_to_coords(facade_polyline)
            facade_length = calculate_polyline_length(facade_coords)
            facade = {
                "id": f"facade-{i + 1}",
                "name": f"Facade {i + 1}",
                "geometry": facade_coords,
                "attributes": {
                    "type": "exterior",
                    "length": facade_length
                }
            }
            facades.append(facade)
    
    # Process circulation
    circulation = []
    if crvCirc:
        for i, circ_polyline in enumerate(crvCirc):
            circ_coords = polyline_to_coords(circ_polyline)
            circ_length = calculate_polyline_length(circ_coords)
            circ = {
                "id": f"circulation-{i + 1}",
                "name": f"Circulation {i + 1}",
                "geometry": circ_coords,
                "attributes": {
                    "type": "circulation",
                    "length": circ_length
                }
            }
            circulation.append(circ)
    
    # Build schema
    schema = {
        "layoutId": layout_id,
        "apartment": apartment,
        "outline": outline_coords,
        "rooms": rooms,
        "doors": doors,
        "facades": facades,
        "circulation": circulation,
        "windows": [],
        "furniture": [],
        "mep": [],
        "structure": []
    }
    description = schema_to_desc(schema)
    schema["description"] = description
    return schema


schema = geometry_to_layout_schema(
    crvBounds,
    crv,
    u,
    crvFacade,
    crvCirc,
    ptCirc,
    layout_id=id,
    apartment_id=id,
    apartment_name=name
)

a = json.dumps(schema, indent=2)
# ---------- end py3 ----------
py3_2 = Python3Script()  # -> out, a; inputs crv: list of Polyline, u: list of String, ptCirc: list of Point3d, crvBounds: Polyline, crvFacade: list of Polyline, crvCirc: list of Polyline, id: String; same code as py3

# ==== cluster Team06ResultCluster

# ----
# Team 06 Result Cluster
# TRIANGULAR PYRAMID TEAM
# Edit Tool Names to
# Match Definition Cluster
tool_names = Panel("""delete_room_06
add_window_06
adapt_layout_06
daylight_06""")

# ----
# Sorting Logic, Please Do Not Edit
tool_call_request = ClusterInput()
tool_names_2 = Text(tool_names)
decall = DeconstructToolCall(Request=tool_call_request)  # -> Request, Tool, Arguments
mindex = MemberIndex(Set=tool_names, Member=decall.Tool)  # -> Index, Count
sift = SiftPattern(List=decall.Request, SiftPattern=mindex.Index)  # -> Output0, Output1, Output2, Output3

decall_2 = DeconstructToolCall(Request=sift.Output2)  # -> Request, Tool, Arguments

# ---- group: Cluster Output
tool_names_3 = ClusterOutput(tool_names_2)

# ---- group: Get the request sent from VSC Agent
decall_3 = DeconstructToolCall(Request=sift.Output3)  # -> Request, Tool, Arguments

# ----
gjok = GetJSONObjectKey(JObject=decall_2.Arguments, Key="input_layout")
gjok_2 = GetJSONObjectKey(JObject=decall_2.Arguments, Key="layout_json")
rjv = ReadJSONValue(JValue=gjok_2)  # -> AsString, AsNumber, AsBool
rjv_2 = ReadJSONValue(JValue=gjok)  # -> AsString, AsNumber, AsBool

# ----
# RPLAN JSON Dataset
json_dataset_path = Panel("C:\Users\giofo\Desktop\ARCHIVIO\MASTERS\MACAD\2_MACAD\0_MACAD DRIVE\AIA\STUDIO\Graph2plan\RPLAN_Extractor\Team06_Export\Rectangular_Only")
trigger = Trigger(Interval=2000, TimerInterval=2000, Target=py3_2)  # disabled
number_slider = Slider(2, range=0..2200)
py3 = Python3Script(path=json_dataset_path, extension=".json")  # -> out, a; inputs path: String, extension: String
# ---------- py3: Python ----------
import os

# Check if the path is valid
if os.path.isdir(path):
    # Get all files in the directory
    all_files = os.listdir(path)
    full_paths = []
    
    for f in all_files:
        if f.endswith(extension):
            # Construct the full file path (e.g., C:\Folder\file.json)
            full_paths.append(os.path.join(path, f))
            
    # Sort the files alphabetically
    full_paths.sort()
    
    # Send the ordered list to output 'a'
    a = full_paths
else:
    a = []
# ---------- end py3 ----------
py3_2 = Python3Script(reset=Button())  # -> out, a, banned_indices
# ---------- py3_2: Python ----------
import scriptcontext as sc

# 1. ADD THE INDICES YOU WANT TO EXCLUDE HERE
banned_indices = [2, 3, 8, 14, 457]  # Just separate them with commas

# 2. Initialize or Reset
if reset or "count" not in sc.sticky:
    sc.sticky["count"] = 0
    # If 0 happens to be banned, skip to the first safe index
    while sc.sticky["count"] in banned_indices and sc.sticky["count"] < 2100:
        sc.sticky["count"] += 1
else:
    # 3. Increment the counter
    if sc.sticky["count"] < 2100:
        sc.sticky["count"] += 1
        
        # WHILE the current number is in the ban list, keep skipping forward
        while sc.sticky["count"] in banned_indices and sc.sticky["count"] < 2100:
            sc.sticky["count"] += 1

# 4. Output the safe index
a = sc.sticky["count"]
b = banned_indices
# ---------- end py3_2 ----------
item = ListItem(List=py3.a, Index=py3_2.a, Wrap=True)
banned_indices = Panel(py3_2.banned_indices)
panel = Panel(py3_2.a)
file = ReadFile(File=item, PerLineParse=False)
item_2 = ListItem(List=py3.a, Index=banned_indices, Wrap=True)  # -> graft(Item)
py3_3 = Python3Script(index=py3_2.a, file_path=file)  # -> out, a; inputs index: Int32, file_path: String
# ---------- py3_3: Python ----------
import os

# 1. CHANGE THIS TO YOUR DESIRED LOG LOCATION
# Use 'r' before the string to handle Windows backslashes properly
log_file = r"C:\Users\giofo\Desktop\ARCHIVIO\MASTERS\MACAD\2_MACAD\0_MACAD DRIVE\AIA\STUDIO\Graph2plan\RPLAN_Extractor\log_debug\gh_crash_log.txt"

try:
    # Extract just the file name (e.g., "data_412.json") from the full path
    file_name = os.path.basename(file_path)
    
    # Write ONLY the index and file name to the disk
    with open(log_file, "w") as f:
        f.write("Last Attempted Index: {}\n".format(index))
        f.write("File Name: {}\n".format(file_name))
        f.write("Full Path: {}".format(file_path))
except Exception as e:
    print("Logging failed: {}".format(str(e)))

# 2. Pass the file path straight through to the next component
a = file_path
# ---------- end py3_3 ----------
panel_2 = Panel(item_2)
panel_3 = Panel(py3_3.a)
fragment = TextFragment(Text=panel_2, Start=Slider(137, range=0..150))  # -> flatten(Fragment)
# RPLAN
banned_layouts = Panel(fragment)

refrence_layout_sample = Text("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")
panel_4 = Panel(refrence_layout_sample)

# ---- group: RPLAN
# RPLAN Schema to Geo
layout_1653 = Panel("""{
  "layoutId": "layout-1653",
  "apartment": {
    "id": "apartment-1653",
    "name": "Sample P",
    "geometry": [
      [
        4.25,
        5.25
      ],
      [
        3.65,
        5.25
      ],
      [
        2.25,
        5.25
      ],
      [
        2.25,
        8.65
      ],
      [
        10.6,
        8.65
      ],
      [
        10.6,
        6.5
      ],
      [
        9.7,
        6.5
      ],
      [
        9.7,
        4.2
      ],
      [
        4.4,
        4.2
      ],
      [
        4.4,
        5.25
      ],
      [
        4.25,
        5.25
      ]
    ],
    "attributes": {
      "area": 37.16,
      "description": "1 balcony, 2 bed, 1 bath, 1 living, 1 kitchen."
    }
  },
  "outline": [
    [
      4.25,
      5.25
    ],
    [
      3.65,
      5.25
    ],
    [
      2.25,
      5.25
    ],
    [
      2.25,
      8.65
    ],
    [
      10.6,
      8.65
    ],
    [
      10.6,
      6.5
    ],
    [
      9.7,
      6.5
    ],
    [
      9.7,
      4.2
    ],
    [
      4.4,
      4.2
    ],
    [
      4.4,
      5.25
    ],
    [
      4.25,
      5.25
    ]
  ],
  "rooms": [
    {
      "id": "room-1",
      "name": "Balcony",
      "geometry": [
        [
          9.7,
          6.5
        ],
        [
          10.6,
          6.5
        ],
        [
          10.6,
          8.65
        ],
        [
          9.7,
          8.65
        ],
        [
          9.7,
          6.5
        ]
      ],
      "attributes": {
        "area": 1.94,
        "program": "outdoor"
      }
    },
    {
      "id": "room-2",
      "name": "Bed",
      "geometry": [
        [
          6.35,
          6.5
        ],
        [
          9.7,
          6.5
        ],
        [
          9.7,
          8.65
        ],
        [
          6.35,
          8.65
        ],
        [
          6.35,
          6.5
        ]
      ],
      "attributes": {
        "area": 7.2,
        "program": "bed"
      }
    },
    {
      "id": "room-3",
      "name": "Bed",
      "geometry": [
        [
          6.35,
          4.2
        ],
        [
          9.7,
          4.2
        ],
        [
          9.7,
          6.5
        ],
        [
          6.35,
          6.5
        ],
        [
          6.35,
          4.2
        ]
      ],
      "attributes": {
        "area": 7.7,
        "program": "bed"
      }
    },
    {
      "id": "room-4",
      "name": "Bath",
      "geometry": [
        [
          4.4,
          4.2
        ],
        [
          6.35,
          4.2
        ],
        [
          6.35,
          5.25
        ],
        [
          4.4,
          5.25
        ],
        [
          4.4,
          4.2
        ]
      ],
      "attributes": {
        "area": 2.05,
        "program": "bath"
      }
    },
    {
      "id": "room-5",
      "name": "Living",
      "geometry": [
        [
          3.15,
          5.25
        ],
        [
          6.35,
          5.25
        ],
        [
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""")
layout_01 = Panel("""{
  "layoutId": "layout-1",
  "apartment": {
    "id": "apartment-1",
    "name": "Sample B",
    "geometry": [
      [
        9.35,
        5.45
      ],
      [
        9.35,
        4.85
      ],
      [
        9.35,
        2.35
      ],
      [
        4.85,
        2.35
      ],
      [
        4.85,
        4.9
      ],
      [
        3.5,
        4.9
      ],
      [
        3.5,
        10.5
      ],
      [
        7.9,
        10.5
      ],
      [
        7.9,
        9.15
      ],
      [
        9.35,
        9.15
      ],
      [
        9.35,
        5.45
      ]
    ],
    "attributes": {
      "area": 47.68,
      "description": "1 balcony, 2 bed, 1 bath, 1 living, 1 kitchen."
    }
  },
  "outline": [
    [
      9.35,
      5.45
    ],
    [
      9.35,
      4.85
    ],
    [
      9.35,
      2.35
    ],
    [
      4.85,
      2.35
    ],
    [
      4.85,
      4.9
    ],
    [
      3.5,
      4.9
    ],
    [
      3.5,
      10.5
    ],
    [
      7.9,
      10.5
    ],
    [
      7.9,
      9.15
    ],
    [
      9.35,
      9.15
    ],
    [
      9.35,
      5.45
    ]
  ],
  "rooms": [
    {
      "id": "room-1",
      "name": "Balcony",
      "geometry": [
        [
          3.5,
          10.5
        ],
        [
          3.5,
          4.9
        ],
        [
          4.85,
          4.9
        ],
        [
          4.85,
          10.5
        ],
        [
          3.5,
          10.5
        ]
      ],
      "attributes": {
        "area": 7.56,
        "program": "outdoor"
      }
    },
    {
      "id": "room-2",
      "name": "Bed",
      "geometry": [
        [
          7.9,
          10.5
        ],
        [
          4.85,
          10.5
        ],
        [
          4.85,
          8.0
        ],
        [
          7.9,
          8.0
        ],
        [
          7.9,
          10.5
        ]
      ],
      "attributes": {
        "area": 7.62,
        "program": "bed"
      }
    },
    {
      "id": "room-3",
      "name": "Bath",
      "geometry": [
        [
          9.35,
          9.15
        ],
        [
          7.9,
          9.15
        ],
        [
          7.9,
          8.0
        ],
        [
          9.35,
          8.0
        ],
        [
          9.35,
          9.15
        ]
      ],
      "attributes": {
        "area": 1.67,
        "program": "bath"
      }
    },
    {
      "id": "room-4",
      "name": "Living",
      "geometry": [
        [
          9.35,
          4.9
        ],
        [
          9.35,
          8.0
        ],
        [
          4.85,
          8.0
        ],
        [
          4.85,
          4.9
        ],
        [
          9.35,
          4.9
        ]
      ],
      "attributes": {
        "area": 13.95,
        "program": "living"
      }
    },
    {
      "id": "room-5",
      "name": "Kitchen",
      "geometry": [
        [
          9.35,
          2.35
        ],
        [
          9.35,
          4.9
        ],
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""")
layout_359 = Panel("""{
  "layoutId": "layout-359",
  "apartment": {
    "id": "apartment-359",
    "name": "Sample V",
    "geometry": [
      [
        9.05,
        6.85
      ],
      [
        9.05,
        5.95
      ],
      [
        9.05,
        2.5
      ],
      [
        3.8,
        2.5
      ],
      [
        3.8,
        10.35
      ],
      [
        9.05,
        10.35
      ],
      [
        9.05,
        6.85
      ]
    ],
    "attributes": {
      "area": 41.21,
      "description": "2 bed, 1 bath, 1 living, 1 foyer, 1 kitchen."
    }
  },
  "outline": [
    [
      9.05,
      6.85
    ],
    [
      9.05,
      5.95
    ],
    [
      9.05,
      2.5
    ],
    [
      3.8,
      2.5
    ],
    [
      3.8,
      10.35
    ],
    [
      9.05,
      10.35
    ],
    [
      9.05,
      6.85
    ]
  ],
  "rooms": [
    {
      "id": "room-1",
      "name": "Bed",
      "geometry": [
        [
          3.8,
          2.5
        ],
        [
          6.25,
          2.5
        ],
        [
          6.25,
          5.2
        ],
        [
          3.8,
          5.2
        ],
        [
          3.8,
          2.5
        ]
      ],
      "attributes": {
        "area": 6.62,
        "program": "bed"
      }
    },
    {
      "id": "room-2",
      "name": "Bath",
      "geometry": [
        [
          3.8,
          5.2
        ],
        [
          5.4,
          5.2
        ],
        [
          5.4,
          7.5
        ],
        [
          3.8,
          7.5
        ],
        [
          3.8,
          5.2
        ]
      ],
      "attributes": {
        "area": 3.68,
        "program": "bath"
      }
    },
    {
      "id": "room-3",
      "name": "Living",
      "geometry": [
        [
          9.05,
          2.5
        ],
        [
          9.05,
          8.2
        ],
        [
          6.25,
          8.2
        ],
        [
          6.25,
          2.5
        ],
        [
          9.05,
          2.5
        ]
      ],
      "attributes": {
        "area": 15.96,
        "program": "living"
      }
    },
    {
      "id": "room-4",
      "name": "Bed",
      "geometry": [
        [
          3.8,
          10.35
        ],
        [
          3.8,
          7.5
        ],
        [
          6.25,
          7.5
        ],
        [
          6.25,
          10.35
        ],
        [
          3.8,
          10.35
        ]
      ],
      "attributes": {
        "area": 6.98,
        "program": "bed"
      }
    },
    {
      "id": "room-5",
      "name": "Foyer",
      "geometry": [
        [
          5.4,
          5.2
        ],
        [
          6.25,
          5.2
        ],
        [
          6.25,
          7.5
        ],
        [
          5.4,
          7.5
        ],
        [
          5.4,
          5.2
        ]
      ],
      "attributes": {
        "area": 1.95,
        "program": "foyer"
      }
    },
    {
      "id": "room-6",
      "name": "Kitchen",
      "geometry": [
        [
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""")
layout_19_rplan = Text(flatten("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"))
extractor = Python3Script(json_str=py3_3.a)  # -> out, outline_curve, room_programs, room_curves, door_names, door_points, window_names, window_curves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; inputs json_str: String
# ---------- extractor: Python ----------
import json
import Rhino.Geometry as rg

# ==========================================
# 1. BULLETPROOF JSON PARSING
# ==========================================
layout = {}

if 'json_str' in globals() and json_str:
    try:
        # Check if Grasshopper passed a pre-parsed dictionary
        if type(json_str).__name__ == 'dict':
            layout = json_str
            
        else:
            raw_text = ""
            
            # Check if Grasshopper passed a list of strings (Multiline panel)
            if isinstance(json_str, (list, tuple)):
                raw_text = "".join([str(item) for item in json_str])
            else:
                # Force whatever it is into a standard python string
                raw_text = str(json_str)
            
            # Clean up Grasshopper's invisible formatting characters
            raw_text = raw_text.strip()
            
            # Parse the clean text
            if raw_text:
                layout = json.loads(raw_text)

    except Exception as e:
        print("JSON Parse Error: {}".format(e))
        layout = {} # Fallback so the component doesn't crash
else:
    print("Waiting for JSON input...")


# ==========================================
# 2. GEOMETRY FUNCTIONS
# ==========================================
def create_polyline(points, close=True):
    if not points or not isinstance(points, list): return None
    gh_pts = []
    for p in points:
        if isinstance(p, (list, tuple)) and len(p) >= 2:
            try:
                gh_pts.append(rg.Point3d(float(p[0]), float(p[1]), 0))
            except (ValueError, TypeError): continue
    if len(gh_pts) < 2: return None
    poly = rg.Polyline(gh_pts)
    if close and gh_pts[0].DistanceTo(gh_pts[-1]) > 0.001:
        poly.Add(gh_pts[0])
    return poly.ToPolylineCurve()

def create_point3d(geo_list):
    if not geo_list or not isinstance(geo_list, list) or len(geo_list) == 0: return None
    inner = geo_list[0]
    if isinstance(inner, list) and len(inner) >= 2:
        try: return rg.Point3d(float(inner[0]), float(inner[1]), 0)
        except: return None
    return None


# ==========================================
# 3. DATA EXTRACTION
# ==========================================
# All variables match the output pins on your component perfectly.

outline_curve = create_polyline(layout.get("outline", []), close=True)

room_programs = []
room_curves = []
for room in layout.get("rooms", []):
    room_programs.append(room.get("attributes", {}).get("program", "unknown"))
    room_curves.append(create_polyline(room.get("geometry", []), close=True))

door_names = []
door_points = []
for door in layout.get("doors", []):
    door_names.append(door.get("name", "Door"))
    door_points.append(create_point3d(door.get("geometry", [])))

window_names = []
window_curves = []
for win in layout.get("windows", []):
    window_names.append(win.get("name", "Window"))
    window_curves.append(create_polyline(win.get("geometry", []), close=False))

furniture_names = []
furniture_curves = []
for fur in layout.get("furniture", []):
    furniture_names.append(fur.get("name", "Furniture"))
    furniture_curves.append(create_polyline(fur.get("geometry", []), close=True))

facade_curves = []
for fac in layout.get("facades", []):
    facade_curves.append(create_polyline(fac.get("geometry", []), close=False))

circulation_curves = []
for circ in layout.get("circulation", []):
    circulation_curves.append(create_polyline(circ.get("geometry", []), close=False))
# ---------- end extractor ----------
c_script = CSharpScript(
    crv=extractor.room_curves,
    u=extractor.room_programs,
    ptCirc=extractor.door_points,
    crvBounds=extractor.outline_curve,
    crvFacade=extractor.facade_curves,
    crvCirc=extractor.circulation_curves,
    Reference=["C:\USERS\GIOFO\DESKTOP\ARCHIVIO\MASTERS\MACAD\2_MACAD\0_MACAD DRIVE\AIA\STUDIO\HYPERGRAPH-ELENA\HYPERGRAPH-MAIN\RESEARCHGEOMETRYLIBRARY\RGEOLIB\BIN\DEBUG\MathNet.Numerics.dll", "C:\USERS\GIOFO\DESKTOP\ARCHIVIO\MASTERS\MACAD\2_MACAD\0_MACAD DRIVE\AIA\STUDIO\HYPERGRAPH-ELENA\HYPERGRAPH-MAIN\RESEARCHGEOMETRYLIBRARY\RGEOLIB\BIN\DEBUG\RGeoLib.dll", "C:\USERS\GIOFO\DESKTOP\ARCHIVIO\MASTERS\MACAD\2_MACAD\0_MACAD DRIVE\AIA\STUDIO\HYPERGRAPH-ELENA\HYPERGRAPH-MAIN\RESEARCHGEOMETRYLIBRARY\RGEOLIB\BIN\DEBUG\Microsoft.Bcl.AsyncInterfaces.dll", "C:\USERS\GIOFO\DESKTOP\ARCHIVIO\MASTERS\MACAD\2_MACAD\0_MACAD DRIVE\AIA\STUDIO\HYPERGRAPH-ELENA\HYPERGRAPH-MAIN\RESEARCHGEOMETRYLIBRARY\RGEOLIB\BIN\DEBUG\System.Buffers.dll", "C:\USERS\GIOFO\DESKTOP\ARCHIVIO\MASTERS\MACAD\2_MACAD\0_MACAD DRIVE\AIA\STUDIO\HYPERGRAPH-ELENA\HYPERGRAPH-MAIN\RESEARCHGEOMETRYLIBRARY\RGEOLIB\BIN\DEBUG\System.Memory.dll", "C:\USERS\GIOFO\DESKTOP\ARCHIVIO\MASTERS\MACAD\2_MACAD\0_MACAD DRIVE\AIA\STUDIO\HYPERGRAPH-ELENA\HYPERGRAPH-MAIN\RESEARCHGEOMETRYLIBRARY\RGEOLIB\BIN\DEBUG\System.Numerics.Vectors.dll", "C:\USERS\GIOFO\DESKTOP\ARCHIVIO\MASTERS\MACAD\2_MACAD\0_MACAD DRIVE\AIA\STUDIO\HYPERGRAPH-ELENA\HYPERGRAPH-MAIN\RESEARCHGEOMETRYLIBRARY\RGEOLIB\BIN\DEBUG\System.Runtime.CompilerServices.Unsafe.dll", "C:\USERS\GIOFO\DESKTOP\ARCHIVIO\MASTERS\MACAD\2_MACAD\0_MACAD DRIVE\AIA\STUDIO\HYPERGRAPH-ELENA\HYPERGRAPH-MAIN\RESEARCHGEOMETRYLIBRARY\RGEOLIB\BIN\DEBUG\System.Text.Encodings.Web.dll", "C:\USERS\GIOFO\DESKTOP\ARCHIVIO\MASTERS\MACAD\2_MACAD\0_MACAD DRIVE\AIA\STUDIO\HYPERGRAPH-ELENA\HYPERGRAPH-MAIN\RESEARCHGEOMETRYLIBRARY\RGEOLIB\BIN\DEBUG\System.Text.Json.dll", "C:\USERS\GIOFO\DESKTOP\ARCHIVIO\MASTERS\MACAD\2_MACAD\0_MACAD DRIVE\AIA\STUDIO\HYPERGRAPH-ELENA\HYPERGRAPH-MAIN\RESEARCHGEOMETRYLIBRARY\RGEOLIB\BIN\DEBUG\System.Threading.Tasks.Extensions.dll", "C:\USERS\GIOFO\DESKTOP\ARCHIVIO\MASTERS\MACAD\2_MACAD\0_MACAD DRIVE\AIA\STUDIO\HYPERGRAPH-ELENA\HYPERGRAPH-MAIN\RESEARCHGEOMETRYLIBRARY\RGEOLIB\BIN\DEBUG\System.ValueTuple.dll"])  # -> out, splitGraphJson, boundsJson, facadeJson, circulationJson, apt; inputs database: String, country: String, city: String, name: String, crv: list of Polyline, u: list of String, ptCirc: list of Point3d, crvBounds: Polyline, crvFacade: list of Polyline, crvCirc: list of Polyline, id: String
# ---------- c_script: C# usings ----------
using System.Linq;
using RGeoLib;
# ---------- c_script: C# ----------
    // IMPORT
    List<Vec3d> inputPt = RhConvert.RhPointListToVec3dList(ptCirc);
    NFace bounds = RhConvert.RhPolylineToNFace(crvBounds);
    List<NLine> facade = RhConvert.RhPolylineListToNLineList(crvFacade);
    List<NLine> circulation = RhConvert.RhPolylineListToNLineList(crvCirc);

    // CONVERT
    NMesh inputMesh = RhConvert.RhPolylineListToNMeshWithNames(crv, u);
    DataNode rootNode = DataNode.dataNodeFromNMeshAndBoundsWithConnectivity(inputMesh, bounds, inputPt);

    // JSON
    splitGraphJson = DataNode.serializeDataNode(rootNode);
    boundsJson = NFace.serializeNFace(bounds);
    facadeJson = NLine.serializeNLineList(facade);
    circulationJson = NLine.serializeNLineList(circulation);

    string jsonBounds = NFace.serializeNFace(bounds);
    string jsonFacade = NLine.serializeNLineList(facade);
    string jsonCirculation = NLine.serializeNLineList(circulation);
    string jsonSplit = DataNode.serializeDataNode(rootNode);


    Apartment newApartment = new Apartment(jsonBounds, jsonFacade, jsonCirculation, jsonSplit);
    newApartment.id = id;
    newApartment.database = database;
    newApartment.country = country;
    newApartment.city = city;
    newApartment.name = name;

    apt = newApartment;
# ---------- end c_script ----------

# ---- group: Extract the tool call parameters
gjok_3 = GetJSONObjectKey(JObject=decall_3.Arguments, Key="layout_json")
gjok_4 = GetJSONObjectKey(JObject=decall_3.Arguments, Key="window_wall_ratio")
rjv_3 = ReadJSONValue(JValue=gjok_3)  # -> AsString, AsNumber, AsBool

# ----
panel_5 = Panel(rjv_2.AsString)
input_layout_sample = Text("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")
panel_6 = Panel(input_layout_sample)
rjv_4 = ReadJSONValue(JValue=gjok_3)  # -> AsString, AsNumber, AsBool
refrence_layout_sample_2 = Text("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")

# ---- group: Get the request sent from VSC Agent
decall_4 = DeconstructToolCall(Request=sift.Output1)  # -> Request, Tool, Arguments

# ----
rjv_5 = ReadJSONValue(JValue=gjok_4)  # -> AsString, AsNumber, AsBool
py3_4 = Python3Script(x=rjv_5.AsNumber)  # -> out, a
# ---------- py3_4: Python ----------
if x:
    a=x
else:
    a=0.5
# ---------- end py3_4 ----------

# ----
# Schema to Geo
extractor_2 = Python3Script(json_str=rjv_2.AsString)  # -> out, outline_curve, facade_curves, circulation_curves
# ---------- extractor_2: Python ----------
import json
import Rhino.Geometry as rg

def load_json_from_string(json_string):
    try:
        data = json.loads(json_string)
    except Exception as e:
        raise ValueError(f"Invalid JSON string: {e}")
    return data

def create_polyline(points, close=True):
    """Create a Rhino PolylineCurve from 2D points"""
    pts = [rg.Point3d(x, y, 0) for x, y in points]

    if close and pts[0] != pts[-1]:
        pts.append(pts[0])

    return rg.Polyline(pts).ToPolylineCurve()

def create_line(points):
    """Create a Rhino LineCurve from 2 points"""
    if len(points) != 2:
        return None
    p1 = rg.Point3d(points[0][0], points[0][1], 0)
    p2 = rg.Point3d(points[1][0], points[1][1], 0)
    return rg.LineCurve(p1, p2)

def create_point3d(point):
    """Create a Rhino Point3d from coordinates"""
    pt = rg.Point3d(point[0][0], point[0][1], 0)
    return pt


# Load JSON
layout = load_json_from_string(json_str)

# ------------------------
# FACADE (polylines)
# ------------------------
facade_curves = []
for facade in layout.get("facades", []):
    geometry = facade.get("geometry")
    if geometry:
        curve = create_polyline(geometry, close=False)
        facade_curves.append(curve)

# ------------------------
# CIRCULATION (polylines)
# ------------------------
circulation_curves = []
for circulation in layout.get("circulation", []):
    geometry = circulation.get("geometry")
    if geometry:
        curve = create_polyline(geometry, close=True)
        circulation_curves.append(curve)

# ------------------------
# OUTLINE
# ------------------------
outline_curve = None
if "outline" in layout:
    outline_curve = create_polyline(layout["outline"], close=True)

# ------------------------
# OUTPUTS
# ------------------------

a = outline_curve
b = facade_curves
c = circulation_curves
# ---------- end extractor_2 ----------

# ----
# Schema to Geo
extractor_3 = Python3Script(json_str=rjv.AsString)  # -> out, outline_curve, room_programs, room_curves, door_names, door_points, window_names, window_curves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
# ---------- extractor_3: Python ----------
import json
import Rhino.Geometry as rg

def load_json_from_string(json_string):
    try:
        data = json.loads(json_string)
    except Exception as e:
        raise ValueError(f"Invalid JSON string: {e}")
    return data

def create_polyline(points, close=True):
    """Create a Rhino PolylineCurve from 2D points"""
    pts = [rg.Point3d(x, y, 0) for x, y in points]

    if close and pts[0] != pts[-1]:
        pts.append(pts[0])

    return rg.Polyline(pts).ToPolylineCurve()

def create_line(points):
    """Create a Rhino LineCurve from 2 points"""
    if len(points) != 2:
        return None
    p1 = rg.Point3d(points[0][0], points[0][1], 0)
    p2 = rg.Point3d(points[1][0], points[1][1], 0)
    return rg.LineCurve(p1, p2)

def create_point3d(point):
    """Create a Rhino Point3d from coordinates"""
    pt = rg.Point3d(point[0][0], point[0][1], 0)
    return pt


# Load JSON
layout = load_json_from_string(json_str)

# ------------------------
# FACADE (polylines)
# ------------------------
facade_curves = []
for facade in layout.get("facades", []):
    geometry = facade.get("geometry")
    if geometry:
        curve = create_polyline(geometry, close=False)
        facade_curves.append(curve)

# ------------------------
# CIRCULATION (polylines)
# ------------------------
circulation_curves = []
for circulation in layout.get("circulation", []):
    geometry = circulation.get("geometry")
    if geometry:
        curve = create_polyline(geometry, close=True)
        circulation_curves.append(curve)

# ------------------------
# ROOMS (polygons)
# ------------------------
room_programs = []
room_curves = []

for room in layout.get("rooms", []):
    program = room.get("attributes", {}).get("program", "unknown")
    if program == "bedroom":
        program = "bed"
    if program =="bathroom":
        program = "bath"
    geometry = room.get("geometry")

    if program and geometry:
        curve = create_polyline(geometry, close=True)
        room_programs.append(program)
        room_curves.append(curve)

# ------------------------
# DOORS (points)
# ------------------------
door_names = []
door_points = []

for door in layout.get("doors", []):
    name = door.get("name")
    geometry = door.get("geometry")

    if name and geometry:
            point = create_point3d(geometry)
            door_names.append(name)
            door_points.append(point)

# ------------------------
# WINDOWS (lines)
# ------------------------
window_names = []
window_curves = []

for window in layout.get("windows", []):
    name = window.get("name")
    geometry = window.get("geometry")

    if name and geometry:
        curve = create_line(geometry)
        if curve:
            window_names.append(name)
            window_curves.append(curve)

# ------------------------
# FURNITURE (polygons)
# ------------------------
furniture_names = []
furniture_curves = []

for furn in layout.get("furniture", []):
    name = furn.get("name")
    geometry = furn.get("geometry")

    if name and geometry:
        curve = create_polyline(geometry, close=True)
        furniture_names.append(name)
        furniture_curves.append(curve)

# ------------------------
# OUTLINE (optional)
# ------------------------
outline_curve = None
if "outline" in layout:
    outline_curve = create_polyline(layout["outline"], close=True)

# ------------------------
# OUTPUTS
# ------------------------
a = room_programs
b = room_curves

c = door_names
d = door_points

e = window_names
f = window_curves

g = furniture_names
h = furniture_curves

i = outline_curve
j = facade_curves
k = circulation_curves
# ---------- end extractor_3 ----------

decall_5 = DeconstructToolCall(Request=sift.Output0)  # -> Request, Tool, Arguments
c_script_2 = CSharpScript(Reference=["C:\USERS\GIOFO\DESKTOP\ARCHIVIO\MASTERS\MACAD\2_MACAD\0_MACAD DRIVE\AIA\STUDIO\HYPERGRAPH-ELENA\HYPERGRAPH-MAIN\RESEARCHGEOMETRYLIBRARY\RGEOLIB\BIN\DEBUG\MathNet.Numerics.dll", "C:\USERS\GIOFO\DESKTOP\ARCHIVIO\MASTERS\MACAD\2_MACAD\0_MACAD DRIVE\AIA\STUDIO\HYPERGRAPH-ELENA\HYPERGRAPH-MAIN\RESEARCHGEOMETRYLIBRARY\RGEOLIB\BIN\DEBUG\RGeoLib.dll", "C:\USERS\GIOFO\DESKTOP\ARCHIVIO\MASTERS\MACAD\2_MACAD\0_MACAD DRIVE\AIA\STUDIO\HYPERGRAPH-ELENA\HYPERGRAPH-MAIN\RESEARCHGEOMETRYLIBRARY\RGEOLIB\BIN\DEBUG\Microsoft.Bcl.AsyncInterfaces.dll", "C:\USERS\GIOFO\DESKTOP\ARCHIVIO\MASTERS\MACAD\2_MACAD\0_MACAD DRIVE\AIA\STUDIO\HYPERGRAPH-ELENA\HYPERGRAPH-MAIN\RESEARCHGEOMETRYLIBRARY\RGEOLIB\BIN\DEBUG\System.Buffers.dll", "C:\USERS\GIOFO\DESKTOP\ARCHIVIO\MASTERS\MACAD\2_MACAD\0_MACAD DRIVE\AIA\STUDIO\HYPERGRAPH-ELENA\HYPERGRAPH-MAIN\RESEARCHGEOMETRYLIBRARY\RGEOLIB\BIN\DEBUG\System.Memory.dll", "C:\USERS\GIOFO\DESKTOP\ARCHIVIO\MASTERS\MACAD\2_MACAD\0_MACAD DRIVE\AIA\STUDIO\HYPERGRAPH-ELENA\HYPERGRAPH-MAIN\RESEARCHGEOMETRYLIBRARY\RGEOLIB\BIN\DEBUG\System.Numerics.Vectors.dll", "C:\USERS\GIOFO\DESKTOP\ARCHIVIO\MASTERS\MACAD\2_MACAD\0_MACAD DRIVE\AIA\STUDIO\HYPERGRAPH-ELENA\HYPERGRAPH-MAIN\RESEARCHGEOMETRYLIBRARY\RGEOLIB\BIN\DEBUG\System.Runtime.CompilerServices.Unsafe.dll", "C:\USERS\GIOFO\DESKTOP\ARCHIVIO\MASTERS\MACAD\2_MACAD\0_MACAD DRIVE\AIA\STUDIO\HYPERGRAPH-ELENA\HYPERGRAPH-MAIN\RESEARCHGEOMETRYLIBRARY\RGEOLIB\BIN\DEBUG\System.Text.Encodings.Web.dll", "C:\USERS\GIOFO\DESKTOP\ARCHIVIO\MASTERS\MACAD\2_MACAD\0_MACAD DRIVE\AIA\STUDIO\HYPERGRAPH-ELENA\HYPERGRAPH-MAIN\RESEARCHGEOMETRYLIBRARY\RGEOLIB\BIN\DEBUG\System.Text.Json.dll", "C:\USERS\GIOFO\DESKTOP\ARCHIVIO\MASTERS\MACAD\2_MACAD\0_MACAD DRIVE\AIA\STUDIO\HYPERGRAPH-ELENA\HYPERGRAPH-MAIN\RESEARCHGEOMETRYLIBRARY\RGEOLIB\BIN\DEBUG\System.Threading.Tasks.Extensions.dll", "C:\USERS\GIOFO\DESKTOP\ARCHIVIO\MASTERS\MACAD\2_MACAD\0_MACAD DRIVE\AIA\STUDIO\HYPERGRAPH-ELENA\HYPERGRAPH-MAIN\RESEARCHGEOMETRYLIBRARY\RGEOLIB\BIN\DEBUG\System.ValueTuple.dll"])  # -> out, splitGraphJson, boundsJson, facadeJson, circulationJson, apt; inputs database: String, country: String, city: String, name: String, crv: list of Polyline, u: list of String, ptCirc: list of Point3d, crvBounds: Polyline, crvFacade: list of Polyline, crvCirc: list of Polyline, id: String; same code as c_script
refrence_layout_sample_3 = Text("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")

# ----
# Schema to Geo
extractor_4 = Python3Script(json_str=rjv_4.AsString)  # -> out, outline_curve, room_ids, room_names, room_programs, room_curves, door_names, door_points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
# ---------- extractor_4: Python ----------
import json
import Rhino.Geometry as rg

def load_json_from_string(json_string):
    try:
        data = json.loads(json_string)
    except Exception as e:
        raise ValueError(f"Invalid JSON string: {e}")
    return data

def create_polyline(points, close=True):
    """Create a Rhino PolylineCurve from 2D points"""
    pts = [rg.Point3d(x, y, 0) for x, y in points]

    if close and pts[0] != pts[-1]:
        pts.append(pts[0])

    return rg.Polyline(pts).ToPolylineCurve()

def create_line(points):
    """Create a Rhino LineCurve from 2 points"""
    if len(points) != 2:
        return None
    p1 = rg.Point3d(points[0][0], points[0][1], 0)
    p2 = rg.Point3d(points[1][0], points[1][1], 0)
    return rg.LineCurve(p1, p2)

def create_point3d(point):
    """Create a Rhino Point3d from coordinates"""
    pt = rg.Point3d(point[0][0], point[0][1], 0)
    return pt


# Load JSON
layout = load_json_from_string(json_str)

# ------------------------
# FACADE (polylines)
# ------------------------
facade_curves = []
for facade in layout.get("facades", []):
    geometry = facade.get("geometry")
    if geometry:
        curve = create_polyline(geometry, close=False)
        facade_curves.append(curve)

# ------------------------
# CIRCULATION (polylines)
# ------------------------
circulation_curves = []
for circulation in layout.get("circulation", []):
    geometry = circulation.get("geometry")
    if geometry:
        curve = create_polyline(geometry, close=True)
        circulation_curves.append(curve)

# ------------------------
# ROOMS (polygons)
# ------------------------
room_ids = []
room_names = []
room_programs = []
room_curves = []

for room in layout.get("rooms", []):
    room_id = room.get("id", "unknown")
    name = room.get("name", "unknown")
    program = room.get("attributes", {}).get("program", "unknown")
    if program == "bedroom":
        program = "bed"
    if program =="bathroom":
        program = "bath"
    geometry = room.get("geometry")

    if room_id and name and program and geometry:
        curve = create_polyline(geometry, close=True)
        room_ids.append(room_id)
        room_names.append(name)
        room_programs.append(program)
        room_curves.append(curve)

# ------------------------
# DOORS (points)
# ------------------------
door_names = []
door_points = []

for door in layout.get("doors", []):
    name = door.get("name")
    geometry = door.get("geometry")

    if name and geometry:
            point = create_point3d(geometry)
            door_names.append(name)
            door_points.append(point)

# ------------------------
# WINDOWS (lines)
# ------------------------
window_names = []
window_curves = []

for window in layout.get("windows", []):
    name = window.get("name")
    geometry = window.get("geometry")

    if name and geometry:
        curve = create_line(geometry)
        if curve:
            window_names.append(name)
            window_curves.append(curve)

# ------------------------
# FURNITURE (polygons)
# ------------------------
furniture_names = []
furniture_curves = []

for furn in layout.get("furniture", []):
    name = furn.get("name")
    geometry = furn.get("geometry")

    if name and geometry:
        curve = create_polyline(geometry, close=True)
        furniture_names.append(name)
        furniture_curves.append(curve)

# ------------------------
# OUTLINE (optional)
# ------------------------
outline_curve = None
if "outline" in layout:
    outline_curve = create_polyline(layout["outline"], close=True)

# ------------------------
# OUTPUTS
# ------------------------
a = room_ids
b = room_names
c = room_programs
d = room_curves

e = door_names
f = door_points

g = window_names
h = window_curves

i = furniture_names
j = furniture_curves

k = outline_curve
l = facade_curves
m = circulation_curves
# ---------- end extractor_4 ----------
panel_7 = Panel(extractor_3.circulation_curves)

# ---- group: Extract the tool call parameters
gjok_5 = GetJSONObjectKey(JObject=decall_4.Arguments, Key="layout_json")
gjok_6 = GetJSONObjectKey(JObject=decall_4.Arguments, Key="room_name")
gjok_7 = GetJSONObjectKey(JObject=decall_4.Arguments, Key="width")
rjv_6 = ReadJSONValue(JValue=gjok_5)  # -> AsString, AsNumber, AsBool

# ----
# Target Layout
crv_core_acessible = Curve(flatten(extractor_2.circulation_curves))
crv_apartments = Curve(simplify(extractor_2.facade_curves))
crv_bounds = Curve(graft(extractor_2.outline_curve))
c_intersection = CSharpScript(
    crvA=crv_apartments,
    crvB=crv_bounds,
    Reference=["C:\USERS\GIOFO\DESKTOP\ARCHIVIO\MASTERS\MACAD\2_MACAD\0_MACAD DRIVE\AIA\STUDIO\HYPERGRAPH-ELENA\HYPERGRAPH-MAIN\RESEARCHGEOMETRYLIBRARY\RGEOLIB\BIN\DEBUG\MathNet.Numerics.dll", "C:\USERS\GIOFO\DESKTOP\ARCHIVIO\MASTERS\MACAD\2_MACAD\0_MACAD DRIVE\AIA\STUDIO\HYPERGRAPH-ELENA\HYPERGRAPH-MAIN\RESEARCHGEOMETRYLIBRARY\RGEOLIB\BIN\DEBUG\RGeoLib.dll", "C:\USERS\GIOFO\DESKTOP\ARCHIVIO\MASTERS\MACAD\2_MACAD\0_MACAD DRIVE\AIA\STUDIO\HYPERGRAPH-ELENA\HYPERGRAPH-MAIN\RESEARCHGEOMETRYLIBRARY\RGEOLIB\BIN\DEBUG\DelaunatorSharp.dll", "C:\USERS\GIOFO\DESKTOP\ARCHIVIO\MASTERS\MACAD\2_MACAD\0_MACAD DRIVE\AIA\STUDIO\HYPERGRAPH-ELENA\HYPERGRAPH-MAIN\RESEARCHGEOMETRYLIBRARY\RGEOLIB\BIN\DEBUG\Clipper2Lib.dll"])  # -> out, simplify(A), B; inputs crvA: list of Polyline, crvB: list of Polyline
# ---------- c_intersection: C# ----------
    List<NLine> linesREF = RhConvert.RhPolylineListToNLineList(crvA);

    List<NLine> linesA = RhConvert.RhPolylineListToNLineList(crvA);
    List<NLine> linesB = RhConvert.RhPolylineListToNLineList(crvB);

    List<NLine> linesC = RIntersection.lineListBooleanIntersectionTol(linesB, linesA, 0.01);

    // conform lines to face
    List<Vec3d> vecOut = new List<Vec3d>();
    for (int i = 0;i < linesC.Count;i++)
    {
      // get closest line in list of lines
      List<NLine> SortedList = linesREF.OrderBy(o => Vec3d.Distance(o.MidPoint, linesC[i].MidPoint)).ToList();
      vecOut.Add(SortedList[0].MidPoint);
      double dotProd = Vec3d.DotProduct(linesC[i].Direction, SortedList[0].Direction);
      if (dotProd <= 0.005)
      {
        linesC[i].FlipLine();
      }
    }


    A = RhConvert.NLineListToRhLineCurveList(linesC);
    B = RhConvert.Vec3dListToRhPoint3dList(vecOut);
# ---------- end c_intersection ----------
c_intersection_2 = CSharpScript(
    crvA=crv_bounds,
    crvB=crv_core_acessible,
    Reference=["C:\USERS\GIOFO\DESKTOP\ARCHIVIO\MASTERS\MACAD\2_MACAD\0_MACAD DRIVE\AIA\STUDIO\HYPERGRAPH-ELENA\HYPERGRAPH-MAIN\RESEARCHGEOMETRYLIBRARY\RGEOLIB\BIN\DEBUG\MathNet.Numerics.dll", "C:\USERS\GIOFO\DESKTOP\ARCHIVIO\MASTERS\MACAD\2_MACAD\0_MACAD DRIVE\AIA\STUDIO\HYPERGRAPH-ELENA\HYPERGRAPH-MAIN\RESEARCHGEOMETRYLIBRARY\RGEOLIB\BIN\DEBUG\RGeoLib.dll", "C:\USERS\GIOFO\DESKTOP\ARCHIVIO\MASTERS\MACAD\2_MACAD\0_MACAD DRIVE\AIA\STUDIO\HYPERGRAPH-ELENA\HYPERGRAPH-MAIN\RESEARCHGEOMETRYLIBRARY\RGEOLIB\BIN\DEBUG\DelaunatorSharp.dll", "C:\USERS\GIOFO\DESKTOP\ARCHIVIO\MASTERS\MACAD\2_MACAD\0_MACAD DRIVE\AIA\STUDIO\HYPERGRAPH-ELENA\HYPERGRAPH-MAIN\RESEARCHGEOMETRYLIBRARY\RGEOLIB\BIN\DEBUG\Clipper2Lib.dll"])  # -> out, simplify(A), B; inputs crvA: list of Polyline, crvB: list of Polyline
# ---------- c_intersection_2: C# ----------
    List<NLine> linesREF = RhConvert.RhPolylineListToNLineList(crvA);

    List<NLine> linesA = RhConvert.RhPolylineListToNLineList(crvA);
    List<NLine> linesB = RhConvert.RhPolylineListToNLineList(crvB);

    List<NLine> linesC = RIntersection.lineListBooleanIntersectionTol(linesB, linesA, 0.01);

    // conform lines to face
    List<Vec3d> vecOut = new List<Vec3d>();
    for (int i = 0;i < linesC.Count;i++)
    {
      // get closest line in list of lines
      List<NLine> SortedList = linesREF.OrderBy(o => Vec3d.Distance(o.MidPoint, linesC[i].MidPoint)).ToList();
      vecOut.Add(SortedList[0].MidPoint);
      double dotProd = Vec3d.DotProduct(linesC[i].Direction, SortedList[0].Direction);
      if (dotProd <= 0.005)
      {
        linesC[i].FlipLine();
      }
    }

    List<NLine> outLines = new List<NLine>();
    
    for (int i = 0; i < linesC.Count; i++)
    {
      if (linesC[i].Length > 0.8)
      {
        outLines.Add(linesC[i]);
      }
    }
    
    //A = RhConvert.NLineListToRhLineCurveList(linesC);
    A = RhConvert.NLineListToRhLineCurveList(outLines);

    B = RhConvert.Vec3dListToRhPoint3dList(vecOut);
# ---------- end c_intersection_2 ----------
crv_apt_units = Curve(simplify(graft(crv_bounds)))
crv_facade = Curve(c_intersection.A)
crv_bounds_2 = Curve(crv_apt_units)
crv_circulation = Curve(c_intersection_2.A)
join = JoinCurves(Curves=crv_facade, Preserve=False)
flip = FlipCurve(Curve=crv_bounds_2)  # -> Curve, Flag
join_2 = JoinCurves(Curves=crv_circulation, Preserve=False)
simplify = SimplifyCurve(Curve=join)  # -> Curve, Simplified
simplify_2 = SimplifyCurve(Curve=crv_bounds_2)  # -> Curve, Simplified
simplify_3 = SimplifyCurve(Curve=join_2)  # -> Curve, Simplified
explode = Explode(Curve=simplify.Curve, Recursive=True)  # -> Segments, Vertices
explode_2 = Explode(Curve=simplify_3.Curve, Recursive=True)  # -> Segments, Vertices

gjok_8 = GetJSONObjectKey(JObject=decall_5.Arguments, Key="layout_json")
gjok_9 = GetJSONObjectKey(JObject=decall_5.Arguments, Key="room_name")

# ----
# Reference Layout
c_script_3 = CSharpScript(
    crv=extractor_3.room_curves,
    u=extractor_3.room_programs,
    ptCirc=extractor_3.door_points,
    crvBounds=extractor_3.outline_curve,
    crvFacade=extractor_3.facade_curves,
    crvCirc=extractor_3.circulation_curves,
    Reference=["C:\USERS\GIOFO\DESKTOP\ARCHIVIO\MASTERS\MACAD\2_MACAD\0_MACAD DRIVE\AIA\STUDIO\HYPERGRAPH-ELENA\HYPERGRAPH-MAIN\RESEARCHGEOMETRYLIBRARY\RGEOLIB\BIN\DEBUG\MathNet.Numerics.dll", "C:\USERS\GIOFO\DESKTOP\ARCHIVIO\MASTERS\MACAD\2_MACAD\0_MACAD DRIVE\AIA\STUDIO\HYPERGRAPH-ELENA\HYPERGRAPH-MAIN\RESEARCHGEOMETRYLIBRARY\RGEOLIB\BIN\DEBUG\RGeoLib.dll", "C:\USERS\GIOFO\DESKTOP\ARCHIVIO\MASTERS\MACAD\2_MACAD\0_MACAD DRIVE\AIA\STUDIO\HYPERGRAPH-ELENA\HYPERGRAPH-MAIN\RESEARCHGEOMETRYLIBRARY\RGEOLIB\BIN\DEBUG\Microsoft.Bcl.AsyncInterfaces.dll", "C:\USERS\GIOFO\DESKTOP\ARCHIVIO\MASTERS\MACAD\2_MACAD\0_MACAD DRIVE\AIA\STUDIO\HYPERGRAPH-ELENA\HYPERGRAPH-MAIN\RESEARCHGEOMETRYLIBRARY\RGEOLIB\BIN\DEBUG\System.Buffers.dll", "C:\USERS\GIOFO\DESKTOP\ARCHIVIO\MASTERS\MACAD\2_MACAD\0_MACAD DRIVE\AIA\STUDIO\HYPERGRAPH-ELENA\HYPERGRAPH-MAIN\RESEARCHGEOMETRYLIBRARY\RGEOLIB\BIN\DEBUG\System.Memory.dll", "C:\USERS\GIOFO\DESKTOP\ARCHIVIO\MASTERS\MACAD\2_MACAD\0_MACAD DRIVE\AIA\STUDIO\HYPERGRAPH-ELENA\HYPERGRAPH-MAIN\RESEARCHGEOMETRYLIBRARY\RGEOLIB\BIN\DEBUG\System.Numerics.Vectors.dll", "C:\USERS\GIOFO\DESKTOP\ARCHIVIO\MASTERS\MACAD\2_MACAD\0_MACAD DRIVE\AIA\STUDIO\HYPERGRAPH-ELENA\HYPERGRAPH-MAIN\RESEARCHGEOMETRYLIBRARY\RGEOLIB\BIN\DEBUG\System.Runtime.CompilerServices.Unsafe.dll", "C:\USERS\GIOFO\DESKTOP\ARCHIVIO\MASTERS\MACAD\2_MACAD\0_MACAD DRIVE\AIA\STUDIO\HYPERGRAPH-ELENA\HYPERGRAPH-MAIN\RESEARCHGEOMETRYLIBRARY\RGEOLIB\BIN\DEBUG\System.Text.Encodings.Web.dll", "C:\USERS\GIOFO\DESKTOP\ARCHIVIO\MASTERS\MACAD\2_MACAD\0_MACAD DRIVE\AIA\STUDIO\HYPERGRAPH-ELENA\HYPERGRAPH-MAIN\RESEARCHGEOMETRYLIBRARY\RGEOLIB\BIN\DEBUG\System.Text.Json.dll", "C:\USERS\GIOFO\DESKTOP\ARCHIVIO\MASTERS\MACAD\2_MACAD\0_MACAD DRIVE\AIA\STUDIO\HYPERGRAPH-ELENA\HYPERGRAPH-MAIN\RESEARCHGEOMETRYLIBRARY\RGEOLIB\BIN\DEBUG\System.Threading.Tasks.Extensions.dll", "C:\USERS\GIOFO\DESKTOP\ARCHIVIO\MASTERS\MACAD\2_MACAD\0_MACAD DRIVE\AIA\STUDIO\HYPERGRAPH-ELENA\HYPERGRAPH-MAIN\RESEARCHGEOMETRYLIBRARY\RGEOLIB\BIN\DEBUG\System.ValueTuple.dll"])  # -> out, splitGraphJson, boundsJson, facadeJson, circulationJson, apt; inputs database: String, country: String, city: String, name: String, crv: list of Polyline, u: list of String, ptCirc: list of Point3d, crvBounds: Polyline, crvFacade: list of Polyline, crvCirc: list of Polyline, id: String; same code as c_script

rjv_7 = ReadJSONValue(JValue=gjok_5)  # -> AsString, AsNumber, AsBool
rjv_8 = ReadJSONValue(JValue=gjok_8)  # -> AsString, AsNumber, AsBool
geometry = Geometry(extractor_4.facade_curves)
rjv_9 = ReadJSONValue(JValue=gjok_7)  # -> AsString, AsNumber, AsBool
deconstruct_brep = DeconstructBrep(Brep=extractor_4.room_curves)  # -> Faces, Edges, Vertices
explode_3 = Explode(Curve=geometry, Recursive=True)  # -> Segments, Vertices
panel_8 = Panel(gjok_9)
curve_middle = CurveMiddle(Curve=deconstruct_brep.Edges)  # -> flatten(Midpoint)

# ---- group: Delete a Space by name
py3_5 = Python3Script(json_str=rjv_8.AsString, room_name=gjok_9)  # -> out, a; inputs room_name: String
# ---------- py3_5: Python ----------
import json
import copy

# Inputs:
# json_str -> JSON as string
# room_name -> e.g. "Kitchen"

def load_json_from_string(json_string):
    try:
        data = json.loads(json_string)
    except Exception as e:
        raise ValueError(f"Invalid JSON string: {e}")
    return data

# Load JSON
data = load_json_from_string(json_str)

# Work on a copy
filtered = copy.deepcopy(data)

# ------------------------
# 1. Find room IDs to remove
# ------------------------
ids_to_remove = set()

for room in filtered.get("rooms", []):
    if room.get("attributes", {}).get("program") == room_name.lower():
        ids_to_remove.add(room.get("id"))

# ------------------------
# 2. Remove from rooms
# ------------------------
filtered["rooms"] = [
    r for r in filtered.get("rooms", [])
    if r.get("id") not in ids_to_remove
]

# ------------------------
# 3. Remove / clean DOORS
# (remove doors that connect to deleted rooms)
# ------------------------
filtered["doors"] = [
    d for d in filtered.get("doors", [])
    if not any(rid in ids_to_remove for rid in d.get("attributes", {}).get("connectsRooms", []))
]

# ------------------------
# 4. Remove WINDOWS linked to deleted rooms
# ------------------------
filtered["windows"] = [
    w for w in filtered.get("windows", [])
    if w.get("attributes", {}).get("roomId") not in ids_to_remove
]

# ------------------------
# 5. Remove FURNITURE linked to deleted rooms
# ------------------------
filtered["furniture"] = [
    f for f in filtered.get("furniture", [])
    if f.get("attributes", {}).get("roomId") not in ids_to_remove
]

# ------------------------
# 6. (Optional) MEP cleanup
# (only if tied to rooms — currently not in your schema)
# ------------------------
# Keeping all MEP elements for now

# ------------------------
# 7. STRUCTURE
# (typically global, so we keep it)
# ------------------------

# ------------------------
# Output ONLY as string
# ------------------------
a = json.dumps(filtered, indent=2)
# ---------- end py3_5 ----------

# ---- group: Get a Specific Room
py3_6 = Python3Script(json_str=rjv_6.AsString, room_name=gjok_6)  # -> out, a; inputs room_name: String
# ---------- py3_6: Python ----------
import json
import Rhino.Geometry as rg

# Inputs:
# json_str -> JSON as string
# room_name -> e.g. "Living Room"

def load_json_from_string(json_string):
    try:
        data = json.loads(json_string)
    except Exception as e:
        raise ValueError(f"Invalid JSON string: {e}")
    return data

def create_polyline(points):
    pts = [rg.Point3d(x, y, 0) for x, y in points]

    # Ensure closed
    if pts[0] != pts[-1]:
        pts.append(pts[0])

    return rg.Polyline(pts).ToPolylineCurve()

# Load JSON
data = load_json_from_string(json_str)

# Find the room
room_curve = None

for room in data.get("rooms", []):
    if room.get("attributes", {}).get("program") == room_name.lower():
        geometry = room.get("geometry")
        if geometry:
            room_curve = create_polyline(geometry)
        break

# Output ONLY the polyline
a = room_curve
# ---------- end py3_6 ----------

# ----
pull_point = PullPoint(Point=curve_middle, Geometry=explode_3.Segments, ClosestOnly=True)  # -> ClosestPoint, Distance, Index
panel_9 = Panel(pull_point.Distance)
txt = Text(py3_5.a)
panel_10 = Panel(py3_6.a)
pjs = ParseJSONString(Text=py3_5.a)
smaller_than = SmallerThan(FirstNumber=pull_point.Distance, SecondNumber="0.01")  # -> SmallerThan, OrEqualTo
division = Division(A=rjv_9.AsNumber, B="2")

# ---- group: Design Logic to Add a Window
room_polyline = Data(py3_6.a)
debrep = DeconstructBrep(Brep=room_polyline)  # -> Faces, Edges, Vertices
item_3 = ListItem(List=debrep.Edges, Index=0, Wrap=True)
midpt = CurveMiddle(Curve=item_3)
X = UnitX(Factor=division)
move = Move(Geometry=midpt, Motion=expr("-x", X))  # -> Geometry, Transform
move_2 = Move(Geometry=midpt, Motion=X)  # -> Geometry, Transform
merge = Merge(Data1=move_2.Geometry, Data2=move.Geometry)

# ----
cull_pattern = CullPattern(List=flatten(deconstruct_brep.Edges), CullPattern=smaller_than.SmallerThan)
floor_height = Panel("3")

target_boundary = Curve(simplify_2.Curve)

# ----
# Apply Layout to Target
apartment_number = Slider(0, range=0..100)
reference_layout = Data(flatten(c_script_3.apt))
target_facades = Curve(simplify(flatten(explode.Segments)))
target_circulation = Curve(simplify(explode_2.Segments))
building_name = Panel("testbuilding")
c_script_4 = CSharpScript(
    targetB=target_boundary,
    targetC=target_circulation,
    targetF=target_facades,
    bldg=building_name,
    aptNum=apartment_number,
    areaFilter=Slider(1, range=0..1),
    refAPT=reference_layout,
    Reference=["C:\USERS\GIOFO\DESKTOP\ARCHIVIO\MASTERS\MACAD\2_MACAD\0_MACAD DRIVE\AIA\STUDIO\HYPERGRAPH-ELENA\HYPERGRAPH-MAIN\RESEARCHGEOMETRYLIBRARY\RGEOLIB\BIN\DEBUG\MathNet.Numerics.dll", "C:\USERS\GIOFO\DESKTOP\ARCHIVIO\MASTERS\MACAD\2_MACAD\0_MACAD DRIVE\AIA\STUDIO\HYPERGRAPH-ELENA\HYPERGRAPH-MAIN\RESEARCHGEOMETRYLIBRARY\RGEOLIB\BIN\DEBUG\RGeoLib.dll", "C:\USERS\GIOFO\DESKTOP\ARCHIVIO\MASTERS\MACAD\2_MACAD\0_MACAD DRIVE\AIA\STUDIO\HYPERGRAPH-ELENA\HYPERGRAPH-MAIN\RESEARCHGEOMETRYLIBRARY\RGEOLIB\BIN\DEBUG\Dbscan.dll"])  # -> out, apts, aptsF, aptsRef; inputs targetB: Polyline, targetC: list of Polyline, targetF: list of Polyline, bldg: String, aptNum: Int32, areaFilter: Double, refAPT: list
# ---------- c_script_4: C# usings ----------
using System.Linq;
using RGeoLib;
using RGeoLib.BuildingSolver;
# ---------- c_script_4: C# ----------
    // GLOBAL VALUES

    NFace boundsTarget = RhConvert.RhPolylineToNFace(targetB);

    NFace boundsTargetFlipped = RhConvert.RhPolylineToNFace(targetB);
    boundsTargetFlipped.flipRH();


    List<Apartment> referenceList = refAPT.Cast<Apartment>().ToList();


    List<NLine> circTarget = RhConvert.RhPolylineListToNLineList(targetC);
    List<NLine> facTarget = RhConvert.RhPolylineListToNLineList(targetF);

    List<NLine> circTargetF = RhConvert.RhPolylineListToNLineList(targetC);
    List<NLine> facTargetF = RhConvert.RhPolylineListToNLineList(targetF);

    for (int i = 0;i < circTargetF.Count; i++)
    {
      circTargetF[i].FlipLineWithhSwap();
    }
    for (int i = 0;i < circTargetF.Count; i++)
    {
      facTargetF[i].FlipLineWithhSwap();
    }

    Apartment targetApartment = new Apartment(boundsTarget, facTarget, circTarget);
    Apartment targetApartmentFlipped = new Apartment(boundsTargetFlipped, facTargetF, circTargetF);

    
    List<Apartment> outAptList = Apartment.fitApartment(bldg, aptNum, referenceList, targetApartment, areaFilter, false, false);
    //List<Apartment> outAptList = Apartment.forceFitApartments(bldg, aptNum, referenceList, targetApartment);

    //List<Apartment> outAptListF = fitApartment(bldg, aptNum, referenceList, targetApartmentFlipped, areaFilter, false, false);

    apts = outAptList;
    //aptsF = outAptListF;

    List<Apartment> refList = new List<Apartment>();

    for (int i = 0;i < outAptList.Count; i++)
    {
      refList.Add(outAptList[i].referenceApartment);
    }

    aptsRef = refList;
# ---------- c_script_4: C# additional code ----------
  public static List<Apartment> fitApartment(string buildingName, int aptNum, List<Apartment> referenceList, Apartment targetApartment, double areaFilter = 0.15, bool cullAccess=true, bool sortByShape=true)
  {
    List<Apartment> chosenAreaRef = Apartment.preFilterByArea(referenceList, targetApartment, areaFilter);
    List<Apartment> apartmentOut = Apartment.createApartmentsFromReference(chosenAreaRef, targetApartment);

    if (cullAccess)
      apartmentOut = Apartment.preFilterByAccessAndProgram(apartmentOut);

    if (sortByShape)
      apartmentOut = Apartment.sortAptsByRoomShape(apartmentOut);

    // Add global properties
    for (int i = 0; i < apartmentOut.Count; i++)
    {
      apartmentOut[i].eval.building = buildingName;
      apartmentOut[i].eval.apartmentNum = aptNum;
    }
    return apartmentOut;
  }
# ---------- end c_script_4 ----------

unit_z = UnitZ(Factor=floor_height)

# ---- group: Creates a Window Object
txt_2 = Text(merge)
window_object = Python3Script(element_id="window-2", name="South Window", geometry=txt_2)  # -> out, window_obj; inputs element_id: String, geometry: list
# ---------- window_object: Python ----------
import json

def parse_point_string(pt_str):
    """
    Converts '{3.5, 0, 0}' -> [3.5, 0.0]
    """
    # Remove braces and spaces
    cleaned = pt_str.strip().replace("{", "").replace("}", "")
    
    # Split into components
    parts = cleaned.split(",")
    
    if len(parts) < 2:
        raise ValueError(f"Invalid point format: {pt_str}")
    
    x = float(parts[0])
    y = float(parts[1])
    
    return [x, y]

def serialize_geometry(geometry_list):
    """
    Converts list of GH strings into [[x,y], [x,y]]
    """
    return [parse_point_string(pt) for pt in geometry_list]

# ------------------------
# Convert geometry
# ------------------------
serialized_geometry = serialize_geometry(geometry)

# Build window object
window_obj = {
    "id": element_id,
    "name": name,
    "geometry": serialized_geometry
}

# Optional attributes
if attributes:
    window_obj["attributes"] = attributes

# Output ONLY as JSON string
window_obj = json.dumps(window_obj, indent=2)
# ---------- end window_object ----------

# ----
extrude = Extrude(Base=cull_pattern, Direction=unit_z)
floor_height_2 = Panel("3")
floor_surface = Geometry(extractor_4.room_curves)
area = Area(Geometry=extrude)  # -> Area, Centroid
midpt_2 = CurveMiddle(Curve=explode_3.Segments)
panel_11 = Panel(c_script_4.apts)
Z = UnitZ(Factor=floor_height_2)
extr = Extrude(Base=floor_surface, Direction=Z)

# ---- group: Merge it to the original layout json
py3_7 = Python3Script(json_str=rjv_6.AsString, new_object=window_object.window_obj)  # -> out, updated_layout
# ---------- py3_7: Python ----------
import json
import copy

def load_json_from_string(json_string):
    try:
        return json.loads(json_string)
    except Exception as e:
        raise ValueError(f"Invalid JSON string: {e}")

def detect_object_type(obj):
    """
    Infer target list from object id prefix.
    """
    obj_id = obj.get("id", "").lower()

    if obj_id.startswith("window"):
        return "windows"
    elif obj_id.startswith("door"):
        return "doors"
    elif obj_id.startswith("furn") or obj_id.startswith("furniture"):
        return "furniture"
    elif obj_id.startswith("mep"):
        return "mep"
    elif obj_id.startswith("wall") or obj_id.startswith("structure"):
        return "structure"
    else:
        # default fallback (safe choice)
        return "windows"

# ------------------------
# Load inputs
# ------------------------
layout = load_json_from_string(json_str)
new_object = json.loads(new_object)  # assuming object comes as JSON string

# Work on copy
updated = copy.deepcopy(layout)

# ------------------------
# Detect target category
# ------------------------
target_key = detect_object_type(new_object)

# ------------------------
# Ensure list exists
# ------------------------
if target_key not in updated:
    updated[target_key] = []

# ------------------------
# Insert object
# ------------------------
updated[target_key].append(new_object)

# ------------------------
# Output JSON string
# ------------------------
updated_layout = json.dumps(updated, indent=2)
# ---------- end py3_7 ----------

# ----
scale = Scale(Geometry=extrude, Center=area.Centroid, Factor=py3_4.a)  # -> Geometry, Transform
scale_2 = Scale(Geometry=explode_3.Segments, Center=midpt_2, Factor=py3_4.a)  # -> Geometry, Transform
cap_holes = CapHoles(Brep=extr)
panel_12 = Panel(scale.Geometry)

# ----
# Extract Geometry
number_slider_2 = Slider(0.25, range=0..1)
c_script_5 = CSharpScript(
    testApt1=c_script_4.apts,
    mergeDelta=number_slider_2,
    wall_inside=Slider(0.075, range=0..0.1),
    wall_outside=Slider(0.12, range=0..1),
    Reference=["C:\USERS\GIOFO\DESKTOP\ARCHIVIO\MASTERS\MACAD\2_MACAD\0_MACAD DRIVE\AIA\STUDIO\hypergraph-elena\hypergraph-main\ResearchGeometryLibrary\RGeoLib\bin\Debug\MathNet.Numerics.dll", "C:\USERS\GIOFO\DESKTOP\ARCHIVIO\MASTERS\MACAD\2_MACAD\0_MACAD DRIVE\AIA\STUDIO\hypergraph-elena\hypergraph-main\ResearchGeometryLibrary\RGeoLib\bin\Debug\RGeoLib.dll", "C:\USERS\GIOFO\DESKTOP\ARCHIVIO\MASTERS\MACAD\2_MACAD\0_MACAD DRIVE\AIA\STUDIO\hypergraph-elena\hypergraph-main\ResearchGeometryLibrary\RGeoLib\bin\Debug\Dbscan.dll", "C:\USERS\GIOFO\DESKTOP\ARCHIVIO\MASTERS\MACAD\2_MACAD\0_MACAD DRIVE\AIA\STUDIO\hypergraph-elena\hypergraph-main\ResearchGeometryLibrary\RGeoLib\bin\Debug\System.Text.Json.dll", "C:\USERS\GIOFO\DESKTOP\ARCHIVIO\MASTERS\MACAD\2_MACAD\0_MACAD DRIVE\AIA\STUDIO\hypergraph-elena\hypergraph-main\ResearchGeometryLibrary\RGeoLib\bin\Debug\Clipper2Lib.dll"])  # -> out, boundsOut, facOut, circOut, rooms, roomsNames, roomsMerged, roomsMergedNames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; inputs mergeDelta: Double, wall_inside: Double, wall_outside: Double
# ---------- c_script_5: C# ----------
    Apartment aptIn = (Apartment) testApt1;

    aptIn.rooms = NMesh.cleanInOut(aptIn.rooms, -mergeDelta);
    aptIn.rooms = NMesh.cleanInOut(aptIn.rooms, mergeDelta);

    rooms = RhConvert.NMeshToRhLinePolylineList(aptIn.rooms);

    aptIn.updateMerged();



    roomsNames = aptIn.getRoomNames();
    roomsMergedNames = aptIn.getRoomMergedNames();

    // Extraction STEP 1: Facade
    facOut = RhConvert.NLineListToRhLineCurveList(aptIn.facade);

    // Extraction STEP 2: Bounds
    NFace bounds = aptIn.bounds;
    bounds.makeCounterClockwise();
    boundsOut = RhConvert.NFaceToRhLineCurveList(bounds);

    // Extraction STEP 3: Circulation
    circOut = RhConvert.NLineListToRhLineCurveList(aptIn.circulation);

    // Extraction STEP 4: Doors
    doorsOut = RhConvert.NLineListToRhLineCurveList(aptIn.doors);

    // Extraction STEP 5: Rooms Merged
    roomsMerged = RhConvert.NMeshToRhLinePolylineList(aptIn.roomsMerged);


    doors_all = RhConvert.NLineListToRhLineCurveList(aptIn.doorsAll);

    ///////////////////////////////////////////////////////////////////////
    ///Visualize Bounds

    NMesh internalMesh = aptIn.roomsMerged;

    List<NFace> outFaces = new List<NFace>();

    for (int i = 0;i < internalMesh.faceList.Count; i++)
    {
      NMesh tempMesh = RClipper.clipperInflatePathsMitterPolygon(internalMesh.faceList[i], -wall_inside);
      outFaces.AddRange(tempMesh.faceList);
    }

    NMesh outMesh = new NMesh(outFaces);

    draw_rooms = RhConvert.NMeshToRhLinePolylineList(outMesh);
    NMesh mergedRoomsNMesh = outMesh;

    NMesh outsideMesh = RClipper.clipperInflatePathsMitterPolygon(bounds, wall_outside);

    draw_bounds = RhConvert.NMeshToRhLinePolylineList(outsideMesh);




    List<NFace> intersectionRoomsList = new List<NFace>();

    for (int i = 0; i < aptIn.rooms.faceList.Count; i++)
    {

      for (int j = 0; j < mergedRoomsNMesh.faceList.Count; j++)
      {
        NMesh intersectionRooms = RClipper.clipperIntersection(aptIn.rooms.faceList[i], mergedRoomsNMesh.faceList[j]);
        intersectionRoomsList.AddRange(intersectionRooms.faceList);
      }
    }

    NMesh outMesh2 = new NMesh(intersectionRoomsList);
    draw_cut_rooms = RhConvert.NMeshToRhLinePolylineList(outMesh2);



    // Populate with furniture:

    ///////////////////////////////////////////
    // Rooms

    // offset inside line

    ///////////////////////////////////////////
    // DOORS


    // Blocked entrance

    // get longest line from entrance lines
    // offset on side and return line

    // Blocked doors
    // get doors

    // add blocking squares

    ///////////////////////////////////////////

    // Room Graph
    // check if in the room graph, the bedroom has an extra room attached:
    // if yes, no storage, if no, storage

    // dining room table only in one?

    ///////////////////////////////////////////////
    // Create Scoring metric


    double doorWidth = 0.8;
    double doorOffset = 0.2;
    double doorClearance = 1.5;
    double wallThickness = -0.15;

    bool leftOrient = true;
    List<NLine> doorActual = new List<NLine>();
    List<NFace> doorDrawing = new List<NFace>();

    for (int i = 0;i < aptIn.doors.Count;i++)
    {

      NLine selectedLine = aptIn.doors[i];

      Vec3d dirVecBlocked = Vec3d.ScaleToLen(selectedLine.Direction, doorOffset + doorWidth + doorOffset);
      Vec3d dirVecOffset = Vec3d.ScaleToLen(selectedLine.Direction, doorOffset);
      Vec3d dirVecDoor = Vec3d.ScaleToLen(selectedLine.Direction, doorWidth);

      //List<NLine> doorBlockedLine = new List<NLine>();
      //List<NLine> doorActual = new List<NLine>();


      /////////////////////////////////////////////////////////////////////////////
      // Check orientation and do left one or right one

      if (leftOrient)
      {
        NLine tempDoor = new NLine(selectedLine.start, selectedLine.start + dirVecBlocked);

        if (tempDoor.Length < selectedLine.Length)
        {
          // DOOR valid if smaller length than right door
          //doorBlockedLine.Add(tempDoor);
          NLine tempActual = new NLine(selectedLine.start + dirVecOffset, selectedLine.start + dirVecOffset + dirVecDoor);
          doorActual.Add(tempActual);

          List<NLine> tempList = new List<NLine>();
          tempList.Add(tempActual);
          NPolyLine tempActualPoly = new NPolyLine(tempList);
          NMesh tempFace = RClipper.clipperInflatePolylineMiterButtMesh(tempActualPoly, wallThickness);
          doorDrawing.AddRange(tempFace.faceList);
        }
      }
      else
      {
        NLine tempDoor = new NLine(selectedLine.end - dirVecBlocked, selectedLine.end);

        if (tempDoor.Length < selectedLine.Length)
        {
          // DOOR valid if smaller length than right door
          //doorBlockedLine.Add(tempDoor);
          NLine tempActual = new NLine(selectedLine.end - dirVecOffset - dirVecDoor, selectedLine.end - dirVecOffset);
          doorActual.Add(tempActual);

          List<NLine> tempList = new List<NLine>();
          tempList.Add(tempActual);
          NPolyLine tempActualPoly = new NPolyLine(tempList);
          NMesh tempFace = RClipper.clipperInflatePolylineMiterButtMesh(tempActualPoly, wallThickness);
          doorDrawing.AddRange(tempFace.faceList);

        }
      }
    }

    doors_center = RhConvert.NLineListToRhLineCurveList(doorActual);



    NMesh doorDrawMesh = new NMesh(doorDrawing);
    doors_rect = RhConvert.NMeshToRhLinePolylineList(doorDrawMesh);
# ---------- c_script_5: C# additional code ----------
  //-----------------------------------------------------------------
# ---------- end c_script_5 ----------

pjs_2 = ParseJSONString(Text=py3_7.updated_layout)

# ---- group: Opaque Faces
# OPAQUE FACES
panel_13 = Panel("TestRoom")
opaque_faces = Geometry(cap_holes)
roomsolid = HBRoomFromSolid(geo=flatten(opaque_faces), name=panel_13, conditioned=True)  # -> report, rooms; plug-in component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

# ---- group: Apertures
# APERTURES
panel_14 = Panel("g_material")
windows_openings = Mesh(scale.Geometry)
glassmod = HBGlassModifier(name=panel_14, trans="0.55")  # -> modifier; plug-in component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
aperture = HBAperture(geo=windows_openings, rad_mod=glassmod)  # -> report, apertures; plug-in component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
addsubface = HBAddSubface(hb_obj=flatten(roomsolid.rooms), sub_faces=flatten(aperture.apertures))  # -> report, hb_obj, unmatched; plug-in component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

# ----
merge_2 = Merge(Data1=flatten(txt), Data2=flatten(py3_7.updated_layout))
respond = MCPToolResponse(Request=decall_4.Request, Content=pjs_2, IsError=False)
respond_2 = MCPToolResponse(Request=decall_5.Request, Content=pjs, IsError=False)

# ---- group: Extractor Tool do map json to grasshopper data
extractor_5 = Python3Script(json_str=merge_2)  # -> out, outline_curve, room_names, room_curves, door_names, door_curves, window_names, window_curves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
# ---------- extractor_5: Python ----------
import json
import Rhino.Geometry as rg

def load_json_from_string(json_string):
    try:
        data = json.loads(json_string)
    except Exception as e:
        raise ValueError(f"Invalid JSON string: {e}")
    return data

def create_polyline(points, close=True):
    """Create a Rhino PolylineCurve from 2D points"""
    pts = [rg.Point3d(x, y, 0) for x, y in points]

    if close and pts[0] != pts[-1]:
        pts.append(pts[0])

    return rg.Polyline(pts).ToPolylineCurve()

def create_line(points):
    """Create a Rhino LineCurve from 2 points"""
    if len(points) != 2:
        return None
    p1 = rg.Point3d(points[0][0], points[0][1], 0)
    p2 = rg.Point3d(points[1][0], points[1][1], 0)
    return rg.LineCurve(p1, p2)

# Load JSON
layout = load_json_from_string(json_str)

# ------------------------
# ROOMS (polygons)
# ------------------------
room_names = []
room_curves = []

for room in layout.get("rooms", []):
    name = room.get("name")
    geometry = room.get("geometry")

    if name and geometry:
        curve = create_polyline(geometry, close=True)
        room_names.append(name)
        room_curves.append(curve)

# ------------------------
# DOORS (lines)
# ------------------------
door_names = []
door_curves = []

for door in layout.get("doors", []):
    name = door.get("name")
    geometry = door.get("geometry")

    if name and geometry:
        curve = create_line(geometry)
        if curve:
            door_names.append(name)
            door_curves.append(curve)

# ------------------------
# WINDOWS (lines)
# ------------------------
window_names = []
window_curves = []

for window in layout.get("windows", []):
    name = window.get("name")
    geometry = window.get("geometry")

    if name and geometry:
        curve = create_line(geometry)
        if curve:
            window_names.append(name)
            window_curves.append(curve)

# ------------------------
# FURNITURE (polygons)
# ------------------------
furniture_names = []
furniture_curves = []

for furn in layout.get("furniture", []):
    name = furn.get("name")
    geometry = furn.get("geometry")

    if name and geometry:
        curve = create_polyline(geometry, close=True)
        furniture_names.append(name)
        furniture_curves.append(curve)

# ------------------------
# MEP (polygons)
# ------------------------
mep_names = []
mep_curves = []

for m in layout.get("mep", []):
    name = m.get("name")
    geometry = m.get("geometry")

    if name and geometry:
        curve = create_polyline(geometry, close=True)
        mep_names.append(name)
        mep_curves.append(curve)

# ------------------------
# STRUCTURE (lines)
# ------------------------
structure_names = []
structure_curves = []

for s in layout.get("structure", []):
    name = s.get("name")
    geometry = s.get("geometry")

    if name and geometry:
        curve = create_line(geometry)
        if curve:
            structure_names.append(name)
            structure_curves.append(curve)

# ------------------------
# OUTLINE (optional)
# ------------------------
outline_curve = None
if "outline" in layout:
    outline_curve = create_polyline(layout["outline"], close=True)

# ------------------------
# OUTPUTS
# ------------------------
a = room_names
b = room_curves

c = door_names
d = door_curves

e = window_names
f = window_curves

g = furniture_names
h = furniture_curves

i = mep_names
j = mep_curves

k = structure_names
l = structure_curves

m = outline_curve
# ---------- end extractor_5 ----------

# ----
# Visualise Results
panel_15 = Panel("""kitchen
bath
foyer
living
bed
extra""")
area_2 = Area(Geometry=c_script_5.rooms, UseTasks=False)  # -> Area, Centroid
foyer = ColourSwatch(SwatchColor=RGB(252, 114, 96))
bed = ColourSwatch(SwatchColor=RGB(58, 38, 102))
kitchen = ColourSwatch(SwatchColor=RGB(100, 48, 105))
bath = ColourSwatch(SwatchColor=RGB(255, 187, 51))
living = ColourSwatch(SwatchColor=RGB(191, 75, 98))
extra = ColourSwatch(SwatchColor=RGB(242, 119, 145))
crv = Curve(c_script_5.draw_cut_rooms)
flip_2 = FlipCurve(Curve=crv)  # -> Curve, Flag
merge_3 = Merge(Data1=kitchen, Data2=bath, Data3=foyer, Data4=living, Data5=bed, Data6=extra)
pt = Point(area_2.Centroid)
rooms_names = Text(c_script_5.roomsNames)
boundary = BoundarySurfaces(Edges=graft(flip_2.Curve), UseTasks=False)  # -> flatten(Surfaces)
replace = ReplaceMembers(Set=rooms_names, Find=panel_15, Replace=merge_3)
rooms = Curve(c_script_5.draw_rooms)
outline = Curve(c_script_5.draw_bounds)
previewlw = CustomPreviewLineweights(Geometry=outline, Shader=ColourSwatch(SwatchColor=RGB(0, 0, 0)), Thickness=Slider(2.7, range=0..10), Absolute=False)
previewlw_2 = CustomPreviewLineweights(Geometry=rooms, Shader=ColourSwatch(SwatchColor=RGB(0, 0, 0)), Thickness=Slider(2, range=0..10), Absolute=False)
preview = CustomPreview(Geometry=flatten(boundary), Material=flatten(replace))
tag = TextTag(Location=pt, Text=rooms_names, Colour=ColourSwatch(SwatchColor=RGB(255, 255, 255)))

# ----
# Geo to Schema
join_3 = JoinCurves(Curves=c_script_5.boundsOut, Preserve=False)
join_4 = JoinCurves(Curves=c_script_5.facOut, Preserve=False)
join_5 = JoinCurves(Curves=c_script_5.circOut, Preserve=False)
doors = CurveMiddle(Curve=c_script_5.doors_center)
programs = Text(c_script_5.roomsNames)
circulation = Geometry(join_5)
outline_2 = Geometry(join_3)
facades = Geometry(join_4)
rooms_2 = Geometry(c_script_5.rooms)
doors_2 = Point(doors)
py3_8 = Python3Script(outline=outline_2, facades=facades, circulation=circulation, programs=programs, rooms=rooms_2, doors=doors_2)  # -> out, json; inputs outline: Curve, facades: Curve, circulation: Curve, programs: list of String, rooms: list of Curve, doors: list of Point3d
# ---------- py3_8: Python ----------
import json
from typing import List, Tuple, Dict, Any
from pathlib import Path


def polyline_to_coords(polyline) -> List[Tuple[float, float]]:
    """Convert Rhino Polyline to list of [x, y] coordinates"""
    coords = []
    for i in range(polyline.PointCount):
        pt = polyline.Point(i)
        coords.append([pt.X, pt.Y])
    return coords


def point3d_to_coords(point) -> Tuple[float, float]:
    """Convert Rhino Point3d to [x, y]"""
    return [point.X, point.Y]


def point3d_to_coords(point) -> Tuple[float, float]:
    """Convert Rhino Point3d to [x, y]"""
    return [point.X, point.Y]


def calculate_polygon_area(coords: List[List[float]]) -> float:
    """Calculate polygon area using shoelace formula"""
    if len(coords) < 3:
        return 0.0
    area = 0.0
    for i in range(len(coords) - 1):
        area += coords[i][0] * coords[i + 1][1]
        area -= coords[i + 1][0] * coords[i][1]
    return abs(area) / 2.0


def calculate_polyline_length(coords: List[List[float]]) -> float:
    """Calculate total length of a polyline"""
    if len(coords) < 2:
        return 0.0
    length = 0.0
    for i in range(len(coords) - 1):
        dx = coords[i + 1][0] - coords[i][0]
        dy = coords[i + 1][1] - coords[i][1]
        length += (dx**2 + dy**2) ** 0.5
    return round(length, 2)


def find_adjacent_rooms(door_coords: List[List[float]], rooms_coords: Dict[str, List[List[float]]]) -> List[str]:
    """Find which rooms a door connects to (simple proximity check)"""
    door_pt = door_coords[0]  # Use first point
    adjacent = []
    
    for room_id, coords in rooms_coords.items():
        # Check if door is near room boundary
        for i in range(len(coords) - 1):
            p1 = coords[i]
            p2 = coords[i + 1]
            dist = point_to_line_distance(door_pt, p1, p2)
            if dist < 0.5:  # Threshold: door within 0.5 units of boundary
                if room_id not in adjacent:
                    adjacent.append(room_id)
                break
    
    return adjacent


def point_to_line_distance(pt: List[float], p1: List[float], p2: List[float]) -> float:
    """Calculate distance from point to line segment"""
    x, y = pt
    x1, y1 = p1
    x2, y2 = p2
    
    denom = (x2 - x1) ** 2 + (y2 - y1) ** 2
    if denom == 0:
        return ((x - x1) ** 2 + (y - y1) ** 2) ** 0.5
    
    t = max(0, min(1, ((x - x1) * (x2 - x1) + (y - y1) * (y2 - y1)) / denom))
    closest_x = x1 + t * (x2 - x1)
    closest_y = y1 + t * (y2 - y1)
    
    return ((x - closest_x) ** 2 + (y - closest_y) ** 2) ** 0.5

def schema_to_desc(schema):
    """
    Convert a layout schema dict (or JSON string) to a simple description string.
    
    Args:
        schema: dict or JSON string representation of layout schema
    
    Returns format:
        "Name (ID). 1 bedroom, 1 bathroom, 1 living room. Area: 600 sqft."
    """
    try:
        # If schema is a string, parse it as JSON first
        if isinstance(schema, str):
            schema = json.loads(schema)
        
        apt = schema.get("apartment", {})
        name = apt.get("name", "?")
        apt_id = apt.get("id", "?")
        area = apt.get("attributes", {}).get("area", 0)
        
        # Count rooms by program
        rooms = schema.get("rooms", [])
        room_counts = {}
        for room in rooms:
            prog = room.get("attributes", {}).get("program", "?")
            room_counts[prog] = room_counts.get(prog, 0) + 1
        
        # Format room counts: "1 bedroom, 2 bathrooms, 1 living room"
        room_str = ", ".join([f"{count} {prog}" for prog, count in sorted(room_counts.items())])
        
        # Simple format
        desc = f"{name} (ID: {apt_id}). {room_str}. Area: {area:.0f} m2."
        return desc
    
    except:
        return "Error parsing schema"
    
def geometry_to_layout_schema(
    crvBounds,
    crv: List,
    u: List[str],
    crvFacade: List = None,
    crvCirc: List = None,
    ptCirc: List = None,
    layout_id: str = "Layout-001",
    apartment_id: str = "apartment-1",
    apartment_name: str = "Sample Apartment"
) -> Dict[str, Any]:
    # Convert bounds
    outline_coords = polyline_to_coords(crvBounds)
    outline_area = calculate_polygon_area(outline_coords)
    
    # Create apartment object
    apartment = {
        "id": apartment_id,
        "name": apartment_name,
        "geometry": outline_coords,
        "attributes": {
            "area": round(outline_area, 2)
        }
    }
    
    # Process rooms
    rooms = []
    rooms_coords = {}
    
    for i, room_polyline in enumerate(crv):
        room_coords = polyline_to_coords(room_polyline)
        room_id = f"room-{i + 1}"
        rooms_coords[room_id] = room_coords
        
        room_program = u[i] if i < len(u) else "unknown"
        room_area = calculate_polygon_area(room_coords)
        
        room = {
            "id": room_id,
            "name": f"{room_program.capitalize()}",

            "geometry": room_coords,
            "attributes": {
                "area": round(room_area, 2),
                "program": room_program
            }
        }
        rooms.append(room)
    
    # Process doors
    doors = []
    if ptCirc:
        for i, door_pt in enumerate(ptCirc):
            door_coords = [point3d_to_coords(door_pt)]
            adjacent_rooms = find_adjacent_rooms(door_coords, rooms_coords)
            
            door = {
                "id": f"door-{i + 1}",
                "name": f"Door {i + 1}",
                "geometry": door_coords,
                "attributes": {
                    "connectsRooms": adjacent_rooms
                }
            }
            doors.append(door)
    
    # Process facades
    facades = []
    if crvFacade:
        for i, facade_polyline in enumerate(crvFacade):
            facade_coords = polyline_to_coords(facade_polyline)
            facade_length = calculate_polyline_length(facade_coords)
            facade = {
                "id": f"facade-{i + 1}",
                "name": f"Facade {i + 1}",
                "geometry": facade_coords,
                "attributes": {
                    "type": "exterior",
                    "length": facade_length
                }
            }
            facades.append(facade)
    
    # Process circulation
    circulation = []
    if crvCirc:
        for i, circ_polyline in enumerate(crvCirc):
            circ_coords = polyline_to_coords(circ_polyline)
            circ_length = calculate_polyline_length(circ_coords)
            circ = {
                "id": f"circulation-{i + 1}",
                "name": f"Circulation {i + 1}",
                "geometry": circ_coords,
                "attributes": {
                    "type": "circulation",
                    "length": circ_length
                }
            }
            circulation.append(circ)
    
    # Build schema
    schema = {
        "layoutId": layout_id,
        "apartment": apartment,
        "outline": outline_coords,
        "rooms": rooms,
        "doors": doors,
        "facades": facades,
        "circulation": circulation,
        "windows": [],
        "furniture": [],
        "mep": [],
        "structure": []
    }
    description = schema_to_desc(schema)
    schema["description"] = description
    return schema

layout = geometry_to_layout_schema(outline, rooms, programs, [facades], [circulation], doors)
json = json.dumps(layout, indent=2)
# ---------- end py3_8 ----------

# ---- group: Polylines
srf = Surface(extractor_5.room_curves)
preview_2 = CustomPreview(Geometry=srf, Material=[ColourSwatch(SwatchColor=RGB(167, 219, 44)), ColourSwatch(SwatchColor=RGB(4, 154, 184))])

# ----
# MODEL & GRIDS
panel_16 = Panel("sample_model_grid")
model = HBModel(rooms=flatten(addsubface.hb_obj), name=panel_16)  # -> report, model; plug-in component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
gridrooms = HBSensorGridFromRooms(rooms=addsubface.hb_obj, grid_size="0.5", dist_floor="0.5", quad_only=Toggle(True))  # -> grid, points, mesh; plug-in component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
vizwiref = HBVisualizeWireframe(hb_objs=flatten(model.model))  # -> geo; plug-in component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
assigngridsviews = HBAssignGridsAndViews(model=model.model, grids=flatten(gridrooms.grid))  # -> model; plug-in component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

# ---- group: Windows
data = Data(extractor_5.window_curves)
previewlw_3 = CustomPreviewLineweights(Geometry=data, Shader=ColourSwatch(SwatchColor=RGB(56, 56, 56)), Thickness=Slider(5.4, range=0..10), Absolute=False)

# ---- group: Labels
area_3 = Area(Geometry=srf)  # -> Area, Centroid
tag_2 = TextTag(Location=area_3.Centroid, Text=extractor_5.room_names)

# ----
vizbytype = HBVisualizeByType(hb_objs=model.model)  # -> walls, interior_walls, roofs, ceilings, exterior_floors, interior_floors, air_walls, apertures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; plug-in component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
preview_3 = CustomPreview(Geometry=vizwiref, Material=ColourSwatch(SwatchColor=RGB(0, 0, 0)))

geometry_2 = Geometry(vizbytype.walls)
pjs_3 = ParseJSONString(Text=py3_8.json)
respond_3 = MCPToolResponse(Request=decall_2.Request, Content=pjs_3, IsError=False)

# ----
# RUN RECIPE
daylightfactor = HBDaylightFactor(model=assigngridsviews, run=Toggle(True))  # -> report, results; plug-in component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

# ----
# Daylight Factor(DF) - Indoors:
# Calculated as
# 
#  (Indoor illuminance/Outdoor illuminance)×100%, under an overcast sky.
# 
# 
# Sky View Factor (SVF) - Outdoors:
# Calculated as the ratio of visible sky area from a point to the entire sky hemisphere, ranging from 0 (no sky visible) to 1 (full sky view).
# DAYLIGHT
# Geometry Preparation
falsestart = LBFalseStartToggle(False)
tag_3 = TextTag(Location=gridrooms.points, Text=daylightfactor.results)
avr = Average(Input=daylightfactor.results)
bnd = Bounds(Numbers=daylightfactor.results)
roundd = RoundToDecimalPlace(NumberX=avr, DecimalPlace="1", RoundType=0)  # -> Rounded, Difference

# ----
# Visualize Results
number_slider_3 = Slider(11, range=0..100)
legendpar = LBLegendParameters(min="0", max="15", seg_count=number_slider_3)  # -> leg_par; plug-in component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
mjoin = MeshJoin(Meshes=gridrooms.mesh)
data_2 = Data(flatten(daylightfactor.results))
heatmap = LBSpatialHeatmap(values=data_2, mesh=mjoin, legend_par=legendpar, legend_title="%")  # -> mesh, legend, title, colors, legend_par, vis_set; plug-in component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
mesh = Mesh(heatmap.mesh)
data_3 = Data(heatmap.legend)

average_daylight_factor = Panel(bnd)
average_daylight_factor_2 = Panel(roundd.Rounded)

# ----
# Create windows objects
windowscurves = Curve(scale_2.Geometry)
end = EndPoints(Curve=windowscurves)  # -> Start, End
pull_point_2 = PullPoint(Point=end.Start, Geometry=graft(extractor_4.room_curves), ClosestOnly=True)  # -> ClosestPoint, Distance, Index
smaller_than_2 = SmallerThan(FirstNumber=pull_point_2.Distance, SecondNumber="0.001")  # -> SmallerThan, OrEqualTo
ma = MassAddition(Input=smaller_than_2.SmallerThan)  # -> Result, PartialResults
cull_pattern_2 = CullPattern(List=flatten(extractor_4.room_ids), CullPattern=flatten(ma.Result))  # -> simplify(graft(List))
cull_pattern_3 = CullPattern(List=flatten(extractor_4.room_names), CullPattern=flatten(ma.Result))
lng = ListLength(List=flatten(cull_pattern_3))
len = Length(Curve=windowscurves)  # -> simplify(graft(Length))
merge_4 = Merge(Data1=graft(end.Start), Data2=graft(end.End))
series = Series(Start=1, Step=1, Count=lng)
expression = Expression(x=len, Expression="round(x*10)/10")
concat = Concatenate(FragmentA=cull_pattern_3, FragmentB=" Window")  # -> simplify(graft(Result))
concat_2 = Concatenate(FragmentA="window-", FragmentB=series)  # -> simplify(graft(Result))
txt_3 = Text(simplify(merge_4))
window_object_2 = Python3Script(element_id=concat_2, room_id=cull_pattern_2, name=concat, geometry=txt_3, width=expression)  # -> out, flatten(window_obj); inputs element_id: String, geometry: list
# ---------- window_object_2: Python ----------
import json

def parse_point_string(pt_str):
    """
    Converts '{3.5, 0, 0}' -> [3.5, 0.0]
    """
    # Remove braces and spaces
    cleaned = pt_str.strip().replace("{", "").replace("}", "")
    
    # Split into components
    parts = cleaned.split(",")
    
    if len(parts) < 2:
        raise ValueError(f"Invalid point format: {pt_str}")
    
    x = float(parts[0])
    y = float(parts[1])
    
    return [x, y]

def serialize_geometry(geometry_list):
    """
    Converts list of GH strings into [[x,y], [x,y]]
    """
    return [parse_point_string(pt) for pt in geometry_list]

# ------------------------
# Convert geometry
# ------------------------
serialized_geometry = serialize_geometry(geometry)

# Build window object
window_obj = {
    "id": element_id,
    "name": name,
    "geometry": serialized_geometry,
    "attributes": {
        "room_id": room_id,
        "width": width
    }
}
# Output ONLY as JSON string
window_obj = json.dumps(window_obj, indent=2)
# ---------- end window_object_2 ----------

# ----
# Add windows
py3_9 = Python3Script(json_str=rjv_4.AsString, new_objects=window_object_2.window_obj)  # -> out, updated_layout; inputs new_objects: list
# ---------- py3_9: Python ----------
import json
import copy

def load_json_from_string(json_string):
    try:
        return json.loads(json_string)
    except Exception as e:
        raise ValueError(f"Invalid JSON string: {e}")

def detect_object_type(obj):
    """
    Infer target list from object id prefix.
    """
    obj_id = obj.get("id", "").lower()

    if obj_id.startswith("window"):
        return "windows"
    elif obj_id.startswith("door"):
        return "doors"
    elif obj_id.startswith("furn") or obj_id.startswith("furniture"):
        return "furniture"
    elif obj_id.startswith("mep"):
        return "mep"
    elif obj_id.startswith("wall") or obj_id.startswith("structure"):
        return "structure"
    else:
        # default fallback (safe choice)
        return "windows"

# ------------------------
# Load inputs
# ------------------------
layout = load_json_from_string(json_str)
 # assuming object comes as JSON string

# ------------------------
# Work in copy
# ------------------------
updated = copy.deepcopy(layout)

# ------------------------
# Detect target category
# ------------------------
def add_object(updated, new_object):
    new_object = json.loads(new_object) 
    target_key = detect_object_type(new_object)
    # Ensure list exists
    if target_key not in updated:
        updated[target_key] = []
    # Insert object
    updated[target_key].append(new_object)

for new_object in new_objects:
    add_object(updated, new_object)

updated_layout = json.dumps(updated, indent=2)
# ---------- end py3_9 ----------

py3_10 = Python3Script(json_str=py3_9.updated_layout, daylight=flatten(roundd.Rounded))  # -> out, updated_layout; inputs daylight: list
# ---------- py3_10: Python ----------
import json
import copy

def load_json_from_string(json_string):
    try:
        return json.loads(json_string)
    except Exception as e:
        raise ValueError(f"Invalid JSON string: {e}")

# ------------------------
# Load inputs
# ------------------------
layout = load_json_from_string(json_str)
 # assuming object comes as JSON string


# ------------------------
# Add daylight to room
# ------------------------
rooms_copy = []
for i, room in enumerate(layout["rooms"]):
    room_copy = copy.deepcopy(room)
    if daylight:
        room_copy["attributes"]["daylight"] = daylight[i]
    else:
        room_copy["attributes"]["daylight"] = 0
    rooms_copy.append(room_copy)

# ------------------------
# Work in copy
# ------------------------
updated= copy.deepcopy(layout)
updated["rooms"]=rooms_copy

updated_layout = json.dumps(updated, indent=2)
# ---------- end py3_10 ----------
pjs_4 = ParseJSONString(Text=py3_10.updated_layout)
respond_4 = MCPToolResponse(Request=decall_3.Request, Content=pjs_4, IsError=False)
or = GateOr(A=respond_2, B=respond, C=respond_3, D=respond_4)
tool_call_success = ClusterOutput(or)
panel_17 = Panel(py3_10.updated_layout)
